# Grasshopper definition HoriStab1.gh (Grasshopper 1.0.8)
# plug-ins: CORE.Grasshopper.Colibri, FEM-Design

# ---- group: Monte Carlo analysis
no_objects = DigitScroller(Scroller_Digits=12, Scroller_Prefix="No. objects", Scroller_Radix=11, Scroller_Value=700)
name_of_input_parameters = Panel("""Lenght
Stiffness index
Elasticity modulus
Height""")
max = Slider(10, range=0..12)
min = Slider(0, range=0..12)
min_2 = Slider(3, range=0..12)
max_2 = Slider(8, range=0..12)
min_3 = Slider(7, range=5..18)
max_3 = Slider(16, range=5..18)
min_4 = Slider(45, range=45..270)
max_4 = Slider(220, range=45..270)
dom = ConstructDomain(DomainStart=min, DomainEnd=max)
random = Random(Range=dom, Number=no_objects, Seed="96342")
dom_2 = ConstructDomain(DomainStart=min_2, DomainEnd=max_2)
dom_3 = ConstructDomain(DomainStart=min_3, DomainEnd=max_3)
dom_4 = ConstructDomain(DomainStart=min_4, DomainEnd=max_4)
expression = Expression(x=random, Expression="(x/2)^3")
random_2 = Random(Range=dom_2, Number=no_objects, Seed="53409")
random_3 = Random(Range=dom_3, Number=no_objects, Seed="49602")
random_4 = Random(Range=dom_4, Number=no_objects, Seed="71937")
bar_graph = BarGraph(random_2, BarColor=RGB(255, 0, 90))
entwine = Entwine(Branch00=random_2, Branch01=expression, Branch02=random_3, Branch03=random_4, FlattenInputs=True)
currentobject = Slider(9, range=0..699)
lng = ListLength(List=entwine)  # -> expr("x-1", Length)
smns = SetMaxNumberSlider(Name="CurrentObject", Max=lng)  # inputs Name: String, Max: Int32
# ---------- smns: Python ----------
ghenv.Component.Name = "SetMaxNumberSlider"
ghenv.Component.NickName = "SMNS"

import Grasshopper as gh
import System

# All objects in Grasshopper script
currentObj = ghenv.Component.OnPingDocument().Objects
# Alternativly add ".Owner.OwnerDocument().Objects" if in cluster

# Looking thorugh all objects
for obj in currentObj:

    # Only object in the GrassHopper Interface
    if type(obj) is gh.Kernel.IGH_DocumentObject:

        # Only the object by the desired name
        if obj.NickName == Name:

            # Study objects
            # print(obj.Slider.Maximum)
            # print(dir(obj.Slider))

            # Setting to integre
            obj.Slider.DecimalPlaces = System.Decimal(0)

            # Setting limits
            obj.Slider.Minimum = System.Decimal(0)
            obj.Slider.Maximum = System.Decimal(Max)
            
            # Ensure downstream objects are refreshed
            obj.ExpireSolution(True)
# ---------- end smns ----------
flip = FlipMatrix(Data=entwine)
branch = TreeBranch(Tree=simplify(flip), Path=currentobject, MaintainPaths=True)
item = ListItem(List=branch, Index="0", Wrap=True)  # -> Item, Item1, Item2, Item3

# ---- group: Load cases
load_cases = Panel("PL")
concat = Concatenate(FragmentA=load_cases, FragmentB="-ordinary-permanent")
panel = Panel(concat)
split = TextSplit(Text=panel, Separators="-")
item_2 = ListItem(List=split, Index=0, Wrap=True)  # -> Item, Item1, Item2
construct = LoadCaseConstruct(Name=item_2.Item, Type=item_2.Item1, DurationClass=item_2.Item2)  # -> flatten(LoadCase)

# ---- group: Geometric properties
length = Slider(5, range=3..8)
format = Format(Format="{0},0,0", Culture=127, Data0=length)
pt = Point(format)
pt_2 = Point("0,0,0")
ln = Line(StartPoint=pt_2, EndPoint=pt)
crv = Curve(ln)

# ---- group: Setting the viewport / Length
num = Number(length)

# ---- group: Setting the viewport
maximum_length = Panel("8")
expression_2 = Expression(x=num, Expression="x/2")
z_trans = Slider(1.4, range=0.1..4)
margins = Slider(0.21, range=0.1..1.1)
X = UnitX(Factor=expression_2)
custom_viewport = Panel("GH_Print")
addition = Addition(A=X, B="0,0,0")
Z = UnitZ(Factor=z_trans)
subtraction = Subtraction(A=addition, B=Z)
addition_2 = Addition(A=margins, B=maximum_length)
xz = XZPlane(Origin=subtraction)
view = ModelView(Perspective=Toggle(False), Location=xz, XExtents=addition_2, YExtents=addition_2)  # -> View, Title, Perspective, Location, Target, XExtents, YExtents
model_viewport = ModelViewport(Viewport=custom_viewport, View=view.View, DisplayMode=custom_viewport)  # -> Viewport, Name, View, DisplayMode
viewport = ModelViewport(model_viewport.Viewport)
cache = ContentCache(Name="T", Content=viewport, Action=Toggle(True))  # -> Name, Content, Result

# ---- group: Material
list = ValueList({"B", "COMMON", "D", "DK", "E", "EST", "FIN", "GB", "H", "LT", "N", "NL", "PL", "RO", "S", "TR"}, selected="DK")
materialdatabase = MaterialDatabase(CountryCode=list)  # -> SteelMaterial, ConcreteMaterial, TimberMaterial, ReinforcementMaterial, StratumMaterial, CustomMaterial
strength_class = ValueList({"C14", "C16", "C18", "C20", "C22", "C24", "C27", "C30", "C35", "C40", "C45"}, selected="C24")
change_valuelist_mat = ChangeValueListMat(find="C", alltypes=materialdatabase.TimberMaterial)
getmaterialbyname_index = MaterialGetMaterialByNameIndex(Materials=materialdatabase.TimberMaterial, MaterialNameIndex=strength_class)

# ---- group: Cross section
sectiondatabase = SectionDatabase()  # -> SteelSection, ConcreteSection, TimberSection, HollowCoreSection, CustomSection
cc_height = ValueList({"70", "95", "120", "145", "170", "195", "220"}, selected="70")
concat_2 = Concatenate(FragmentA="Timber section, ", FragmentB="DressedLumber, 45x")
change_valuelist_section = ChangeValueListSection(find="DressedLumber, 45x", alltypes=sectiondatabase.TimberSection)
concat_3 = Concatenate(FragmentA=concat_2, FragmentB=cc_height)
getsectionbyname_index = SectionGetSectionByNameIndex(Sections=sectiondatabase.TimberSection, SectionNameIndex=concat_3)

# ---- group: Geometric properties / Rnd L
num_2 = Number(item.Item)

# ---- group: Custom material / Rnd E
num_3 = Number(item.Item2)

# ---- group: Arbitrary section / Rnd h
num_4 = Number(expr("x*1E-3", item.Item3))

# ---- group: Arbitrary section
panel_2 = Panel("""0,0,0
{1},0,0
{1},{0},0
0,{0},0""")
width_b = Panel("0.045")
format_2 = Format(Format=panel_2, Culture=127, Data0=num_4, Data1=width_b)
eval = Evaluate(E="Format(\"{0:0}x{1:0}\", b*1E3, h*1E3)", b=width_b, h=num_4)
list_2 = ValueList({"SteelRolled", "SteelColdWorked", "SteelWelded", "Concrete", "Timber", "Unknown", "Undefined"}, selected="Timber")
item_3 = ListItem(List=format_2, Index="0", Wrap=True)  # -> Item, Item1, Item2, Item3
srf4pt = _4PointSurface(CornerA=item_3.Item, CornerB=item_3.Item1, CornerC=item_3.Item2, CornerD=item_3.Item3)
define = SectionDefine(Surfaces=srf4pt, MaterialType=list_2, GroupName="T", TypeName="T", SizeName=eval)

# ---- group: Custom material / Working directory + file
current_folder_file = Python3Script(filename="CustomMat.struxml")  # -> path; inputs filename: String
# ---------- current_folder_file: Python ----------
"""Grasshopper Script Instance"""
import System
import Rhino
import Grasshopper

import rhinoscriptsyntax as rs

class MyComponent(Grasshopper.Kernel.GH_ScriptInstance):
    def RunScript(self, filename: str):

        # Get the current document path
        folder = rs.DocumentPath() 

        # Define the file path
        path = folder + str(filename)

        return path
# ---------- end current_folder_file ----------

# ---- group: Custom material
tab_2_en_384_2016 = Panel("E0mean/16")
eval_2 = Evaluate(E=tab_2_en_384_2016, E0mean=num_3)
create_material_database = Python3Script(G=eval_2, E=num_3, path=current_folder_file)  # -> path; inputs G: Double, E: Double
# ---------- create_material_database: Python ----------
import System
import Rhino
import Grasshopper

import rhinoscriptsyntax as rs

class MyComponent(Grasshopper.Kernel.GH_ScriptInstance):
    def RunScript(self, G: float, E: float, path):
        """
        Creates a custom material with a given E and G,
        by updating or creating a .struxml file.
        
        Args:
            path_out: Path to write the .struxml file
            E:        Value for E0mean in [GPa]
            G:        Value for Gmean in [GPa]
        """
        
        # Static guid
        static_guid = "15de474f-bdf8-4ebc-a9b6-f137e4616f71"  

        # Defining names to be displayed
        MatName = f'E{E:.2f}'


        # Converting units to [MPa]
        E = E*1E3
        G = G*1E3
        
        # Struxml structure with E and G
        struxml_content = f'''<?xml version="1.0" encoding="UTF-8"?>
        <!-- (c) StruSoft 2012-2023, http://www.strusoft.com -->
        <database struxml_version="01.00.000" source_software="FEM-Design 23.00.006" start_time="1970-01-01T00:00:00.000" end_time="2022-04-25T11:57:24.000" guid="5bd0e6af-1baf-4f73-8369-015724045a94" convertid="00000000-0000-0000-0000-000000000000" standard="EC" country="DK" xmlns="urn:strusoft">
        <materials>
            <material guid="{static_guid}" last_change="2021-01-07T13:38:43.000" action="added" standard="EC" country="DK" name="{MatName}">
                <timber mass="0" E_0="0" E_1="0" E_2="0" nu_0="0" nu_1="0" nu_2="0" alfa_0="0.001" alfa_1="0.001" alfa_2="0.001"
                        G_0="0" G_1="0" G_2="0" type="0" quality="0"
                        Fmk0="14" Fmk90="14" Ft0k="7.2" Ft90k="0.4" Fc0k="16" Fc90k="2" Fvk="3"
                        E0mean="{E}" E90mean="230" E0comp="{E}" E90comp="230"
                        Gmean="{G}" E005="4700" G005="294" Rhok="290" Rhomean="350"
                        gammaM_0="1.35" gammaM_1="1" ksys="1" k_cr="1" service_class="0"
                        kdefU="0" kdefSq="0.6" kdefSf="0.6" kdefSc="0.6" gammaMfi="1">
                </timber>
            </material>
        </materials>
        <end></end>
        </database>'''
        
        # Creates or updates the .struxml-file
        with open(path, 'w', encoding='utf-8') as f:
            f.write(struxml_content)

        return path
# ---------- end create_material_database ----------
extract_material = Python3Script(path=create_material_database)  # -> material; inputs path: String, name: String
# ---------- extract_material: Python ----------
import System
import Rhino
import Grasshopper

import rhinoscriptsyntax as rs

import FemDesign

class MyComponent(Grasshopper.Kernel.GH_ScriptInstance):
    def RunScript(self, path: str, name: str):

        # Material database
        MD = FemDesign.Materials.MaterialDatabase.DeserializeStruxml(path)

        # Checking object functions
        # print(dir(MD.Materials))

        # Source files and documentation
        # Core: https://github.com/strusoft/femdesign-api/blob/19f2a93505b7a54293e57934e64f03d87de3a1a0/FemDesign.Core/Materials/MaterialDatabase.cs#L107
        # GH Comp.: https://github.com/strusoft/femdesign-api/blob/19f2a93505b7a54293e57934e64f03d87de3a1a0/FemDesign.Grasshopper/Materials/MaterialDatabase.cs
        
        # Number material in database
        N = MD.Materials.Material.get_Count()

        # Return material if singular else filter by name
        if N == 1:
            return MD.Materials.Material
        else:
            return MD.MaterialByName(name)

        # Convert to normal Python list
        # p_list = [str(item) for item in MD.MaterialNames()]
        # print(python_list)
# ---------- end extract_material ----------

# ---- group: Stiff. index to rot. stiff. / Rnd C
num_5 = Number(item.Item1)

# ----
pt_3 = Point([pt, pt_2])

# ---- group: Load combinations
list_3 = ValueList({"ultimate_ordinary", "ultimate_accidental", "ultimate_seismic", "serviceability_quasi_permanent", "serviceability_frequent", "serviceability_characteristic"}, selected="ultimate_ordinary")
construct_2 = LoadCombinationConstruct(Name="ULS_DL", Type=list_3, LoadCase=construct, Gamma="1.00")  # -> flatten(LoadCombination)

# ---- group: Applied load
lineload_amp_kn_m = Panel("3")
Z_2 = UnitZ(Factor=expr("-x", lineload_amp_kn_m))
X_2 = UnitX(Factor=lineload_amp_kn_m)
item_4 = ListItem(List=crv, Index="0", Wrap=True)
lineload_define = LineLoadDefine(Curve=item_4, StartForce=Z_2, LoadCase=construct, ConstLoadDir=True, LoadProjection=False, Type="Force")

# ----
beam = BarsBeam(Curve=crv, Material=getmaterialbyname_index, Section=getsectionbyname_index, OrientLCS=True, Identifier="B")
improved_material_deconstruc = Python3Script(Material=getmaterialbyname_index)  # -> E0mean, Gmean
# ---------- improved_material_deconstruc: Python ----------
import System
import Rhino
import Grasshopper

import rhinoscriptsyntax as rs

class MyComponent(Grasshopper.Kernel.GH_ScriptInstance):
    def RunScript(self, Material):
        
        # Extracting timber proporties
        T = Material.Timber

        return T.E0mean, T.Gmean
# ---------- end improved_material_deconstruc ----------

# ---- group: Options
numelem = Slider(21, range=2..21)
panel_3 = Panel("Millimeters")
create_folder_and_return_path = Python3Script(FileName="Frame_bar.str", FolderName="SavedModels")  # -> out, path; inputs FileName: String, FolderName: String
# ---------- create_folder_and_return_path: Python ----------
"""Grasshopper Script Instance"""
import System
import Rhino
import Grasshopper

import rhinoscriptsyntax as rs
import os

class MyComponent(Grasshopper.Kernel.GH_ScriptInstance):
    def RunScript(self, FileName: str, FolderName: str):

        # Get the current document path
        folder = rs.DocumentPath() 

        # Define the folder path
        save_folder = os.path.join(folder, FolderName)

        # Create folder if it doesn't exist
        if not os.path.exists(save_folder):
            os.makedirs(save_folder)
            print(f"Created missing folder: {save_folder}")

        # Define the model file path
        file_path = os.path.join(save_folder, FileName)

        return file_path
# ---------- end create_folder_and_return_path ----------
rep = ReplaceText(Text=panel_3, Find=panel_3, Replace="mm", RecursiveReplace=False)
units = Units(Length=rep, Angle="rad", SectionalData="m", Force="kN", Mass="kg", Displacement="mm", Stress="Pa")
change_no_element_division = Python3Script(NumElem=numelem)  # -> out, path; inputs NumElem: Int32
# ---------- change_no_element_division: Python ----------
"""Grasshopper Script Instance"""
import System
import Rhino
import Grasshopper

import rhinoscriptsyntax as rs
import xml.etree.ElementTree as ET
import os

# Default XML content
DEFAULT_XML_CONTENT = """<?xml version="1.0" encoding="UTF-8"?>
<!-- (c) StruSoft 2012-2021, http://www.strusoft.com -->
<cmdglobalcfg command="$ FEM $CODE(GLOBALCFG)">
    <!-- modify the value below if you want to change the Globalcfg setting -->
    <!-- attributes that start with 'f' must be 0 or 1 -->
    <!-- attributes that start with 'r' are double numbers -->
    <!-- attributes that start with 's' are integer numbers -->
    <soil_calculation
        fSoilAsSolid = "0" />
    <mesh_general
        fAdjustToLoads = "0" />
    <mesh_elements
        fElemCalcRegion = "1"
        rElemSizeDiv = "6.0"
        fCorrectToMinDivNum = "1"
        sDefaultDivision = "2"
        rDefaultAngle = "15.0" />
    <mesh_functions
        fRefineLocally = "1"
        sRefineMaxStepNum = "5"
        fMaxIterWarning = "0"
        fReduceSize = "1"
        sSmoothStepNum = "3"
        fCheckMeshGeom = "1"
        rCheckGeomMinAngle = "10.0"
        rCheckGeomMaxAngle = "170.0"
        rCheckGeomMaxSideRatio = "8.0"
        fCheckMeshOverlap = "1"
        fCheckMeshTopology = "1" />
    <mesh_prepare
        fAutoRegen = "1"
        fThPeak = "1"
        fThBeam = "0"
        fThColumn = "1"
        fThTruss = "0"
        fThFicBeam = "0"
        fThFreeEdge = "0"
        fThRegionBorder = "0"
        fThSuppPt = "1"
        fThSuppLn = "0"
        fThSuppSf = "0"
        fThEdgeConn = "0"
        fThConnPt = "0"
        fThConnLn = "0"
        fThConnSf = "0"
        fThLoadPt = "0"
        fThLoadLn = "0"
        fThLoadSf = "0"
        fThFixPt = "0"
        fThFixLn = "0"
        fAutoRebuild = "1"
        fAutoSmooth = "1"
        fAutoCheck = "0" />
    <peaksm_method
        sPeakFormFunc_M = "1"
        sPeakFormFunc_N = "1"
        sPeakFormFunc_V = "1" />
    <peaksm_auto
        fPeakBeam = "0"
        fPeakColumn = "1"
        fPeakTruss = "0"
        fPeakFicBeam = "0"
        fPeakPlate = "0"
        fPeakWall = "0"
        fPeakFicShell = "0"
        fPeakSuppPt = "1"
        fPeakSuppLn = "0"
        fPeakSuppSf = "0"
        fPeakConnPt = "0"
        fPeakConnLn = "0"
        fPeakConnSf = "0"
        rPeakFactor = "0.5" />
</cmdglobalcfg>"""

class MyComponent(Grasshopper.Kernel.GH_ScriptInstance):
    def RunScript(self, NumElem: int):

        # Get the current document path
        folder = rs.DocumentPath() 

        # Define the GlobalConfig folder path
        global_config_folder = os.path.join(folder, "GlobalConfig")

        # Create GlobalConfig folder if it doesn't exist
        if not os.path.exists(global_config_folder):
            os.makedirs(global_config_folder)
            print(f"Created missing folder: {global_config_folder}")

        # Define the XML file path
        xml_file = os.path.join(global_config_folder, "cmdglobalcfg.xml")

        # If the XML file doesn't exist, create it with default content
        if not os.path.exists(xml_file):
            with open(xml_file, "w", encoding="UTF-8") as f:
                f.write(DEFAULT_XML_CONTENT)
            print(f"Created missing file: {xml_file}")
        
        # Parse the XML file
        tree = ET.parse(xml_file)
        root = tree.getroot()
        
        # Find the mesh_elements tag and update the sDefaultDivision attribute
        for elem in root.findall("mesh_elements"):
            if "sDefaultDivision" in elem.attrib:
                elem.set("sDefaultDivision", str(NumElem))
                print(f"Updated sDefaultDivision to {NumElem}")
        
        # Create a new filename with the new value in the GlobalConfig folder
        new_filename = os.path.join(global_config_folder, f"cmdglobalcfg_{NumElem}.xml")
        
        # Save the modified XML to the new file
        tree.write(new_filename, encoding="UTF-8", xml_declaration=True)

        return new_filename
# ---------- end change_no_element_division ----------

# ---- group: Results
resultstype = ResultsType({"NodalDisplacement", "PointSupportReaction", "PointSupportReactionMinMax", "LineSupportReaction", "LineSupportResultant", "SurfaceSupportReaction", "SurfaceSupportResultant", "BarInternalForce", "BarDisplacement", "BarEndForce"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}, selected="BarDisplacement")
resultstype_2 = ResultsType({"NodalDisplacement", "PointSupportReaction", "PointSupportReactionMinMax", "LineSupportReaction", "LineSupportResultant", "SurfaceSupportReaction", "SurfaceSupportResultant", "BarInternalForce", "BarDisplacement", "BarEndForce"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}, selected="BarInternalForce")
analysis = AnalysisDefine(CalcCase=Toggle(True), CalcComb=True, CalcGmax=False, CalcDesign=False, Elemfine=True, Diaphragm=0, PeakSmoothing=False)
merge = Merge(Data1=resultstype, Data2=resultstype_2)

# ----
disp_loadcase = Panel("PL")

# ---- group: Line types
# Actual
# Outline (legend)
# Expected
# Legend "lines"
# Model lines
space = Slider(0.06, range=0.01..0.3)
panel_4 = Panel("""1
-1""")
multiplication = Multiplication(A="50", B=panel_4)
linetype = ModelLinetype(Name="ac", CapStyle="0", JoinStyle="1", Width=Slider(0.02, range=0.01..0.1))
linetype_2 = ModelLinetype(Name="ex", Segments=multiplication, CapStyle="1", JoinStyle="1", Width=Slider(0.02, range=0.01..0.1))
linetype_3 = ModelLinetype(Name="ol", CapStyle="1", JoinStyle="1", Width=Slider(0.02, range=0.01..0.1))
linetype_4 = ModelLinetype(Name="ll", CapStyle="1", JoinStyle="1", Width=Slider(0.25, range=0.01..0.3))
linetype_5 = ModelLinetype(Name="ml", CapStyle="0", JoinStyle="1", Width=Slider(0.02, range=0.01..0.3))
entwine_2 = Entwine(
    Branch00=linetype,
    Branch01=linetype_3,
    Branch02=linetype_4,
    Branch03=linetype_5,
    Branch04=ColourSwatch(SwatchColor=RGB(107, 107, 107)),
    FlattenInputs=True)
linetype_6 = ModelLinetype([linetype, linetype_2, linetype_3, linetype_4, linetype_5])

# ---- group: Traditional Colibri
panel_5 = Panel("""0
0
7
0""")
panel_6 = Panel("""4
1
1
1""")
sub_domain = ColibriIterationSubdomain(Divisions=panel_5)

# ---- group: Parametric analysis
# https://tt-acm.github.io/DesignExplorer/
panel_7 = Panel("4")
sub_domain_2 = ColibriIterationSubdomain(Divisions=panel_7)
colibri_in = ColibriInputsIterator(Selection=sub_domain_2, CurrentObject=currentobject, ignoreAllWarningMsg=True)  # -> UniqueName, Inputs, CurrentObject
resolution = Slider(2100, range=400..2100)
set_img = ColibriImageSetting(ImageSaveAsName="defaultName", RhinoViewNames=custom_viewport, Width=resolution, Height=resolution)
create_folder_s = Python3Script(FolderName="Colibri\Bar2")  # -> out, path; inputs FolderName: String
# ---------- create_folder_s: Python ----------
"""Grasshopper Script Instance"""
import System
import Rhino
import Grasshopper

import rhinoscriptsyntax as rs
import os

class MyComponent(Grasshopper.Kernel.GH_ScriptInstance):
    def RunScript(self, FolderName: str):

        # Get the current document path
        folder = rs.DocumentPath() 

        # Define the full path by joining with user-specified FolderName
        # Normalize FolderName to handle both '/' and '\\'
        normalized_subpath = os.path.normpath(FolderName)

        # Combine the base folder with the normalized subpath
        save_folder = os.path.join(folder, normalized_subpath)

        # Create all intermediate folders if they don't exist
        if not os.path.exists(save_folder):
            os.makedirs(save_folder)
            print(f"Created missing folders up to: {save_folder}")

        # Return the path to the innermost folder
        return save_folder
# ---------- end create_folder_s ----------

# ---- group: Stiff. index to rot. stiff.
stiffness_index = Slider(3, range=0..8, expression="(x/2)^3")
panel_8 = Panel("""1E-3
4E-3""")

# ---- group: Traditional Colibri (continued)
colibri_in_2 = ColibriInputsIterator(
    S=sub_domain,
    Length=length,
    Stiffness_index=stiffness_index,
    Strength_class=strength_class,
    CC_Height=cc_height,
    ignoreAllWarningMsg=True)  # -> U, IP, Length, Stiffness_index, Strength_class, CC_Height

# ---- group: Supports
panel_9 = Panel("""0
0""")
panel_10 = Panel("""1E14
1E14""")
panel_11 = Panel("""1E14
1E14""")
num_6 = Number(panel_9)
num_7 = Number(panel_10)
num_8 = Number(panel_11)
construct_3 = MotionsConstruct(X_neg=num_7, X_pos=num_7, Y_neg=num_8, Y_pos=num_8, Z_neg=num_8, Z_pos=num_8)

# ---- group: Theoretical values
deconstruct = SectionDeconstruct(Section=getsectionbyname_index)  # -> Guid, Name, Surfaces, SectionType, MaterialType, GroupName, TypeName, SizeName
deconstruct_2 = LineLoadDeconstruct(LineLoad=lineload_define)  # -> Guid, Type, Curve, Direction, Q1, Q2, LoadCaseGuid, Comment
len = Length(Curve=crv)
item_5 = ListItem(List=deconstruct_2.Q1, Index=0, Wrap=True)
no_points = Slider(77, range=2..100)
multiplication_2 = Multiplication(A=item_5, B="-1E3")
dom_5 = ConstructDomain(DomainStart=0, DomainEnd=len)
range = Range(Domain=dom_5, Steps=no_points)
multiplication_3 = Multiplication(A=improved_material_deconstruc.Gmean, B="1E6")
multiplication_4 = Multiplication(A=improved_material_deconstruc.E0mean, B="1E6")
expressions_for_timoshenko_semi_rigid_co = ExpressionsForTimoshenkoSemiRigidConnections()  # "Expressions for Timoshenko semi-rigid connections"
X_3 = UnitX(Factor=range)
panel_12 = Panel("""1
-1E-3
1E-3""")

# ---- group: Stiff. index to rot. stiff. / E0mean
num_9 = Number(multiplication_4)

# ----
dim = Dimensions(Surface=deconstruct.Surfaces)  # -> UDimension, VDimension

# ---- group: Theoretical values (continued)
expression_3 = Expression(b=dim.UDimension, h=dim.VDimension, Expression="b*h")
expression_4 = Expression(b=dim.UDimension, h=dim.VDimension, Expression="1/12*b*h^3")
multiplication_5 = Multiplication(A=expression_3, B="(1E0)^2")
multiplication_6 = Multiplication(A=expression_4, B="(1E0)^4")

# ---- group: Stiff. index to rot. stiff. / Iy
num_10 = Number(multiplication_6)

# ---- group: Stiff. index to rot. stiff. (continued)
expression_5 = Expression(E=num_9, Iy=num_10, L=length, C=stiffness_index, Expression="E*Iy*C/L")
multiplication_7 = Multiplication(A=expression_5, B=panel_8)

# ---- group: Supports (continued)
num_11 = Number(multiplication_7)
construct_4 = RotationsConstruct(X_neg=num_6, X_pos=num_6, Y_neg=num_11, Y_pos=num_11, Z_neg=num_6, Z_pos=num_6)
construct_5 = PointSupportConstruct(PointPlane=pt_3, Motions=construct_3, Rotations=construct_4, Identifier="S")

# ----
panel_13 = Panel(construct_5)
data = Data(flatten([construct_5, beam]))
construct_6 = ModelConstruct(CountryCode="DK", StructureElements=data, Loads=lineload_define, LoadCases=construct, LoadCombinations=construct_2)
runapplication = ApplicationRun(
    Model=construct_6,
    Analysis=analysis,
    ResultTypes=merge,
    Units=units,
    GlobalConfig=change_no_element_division.path,
    SaveFilePath=create_folder_and_return_path.path,
    RunNode=Toggle(True),
    keepOpen=False,
    minimised=True)  # -> Model, FiniteElement, Results
bang = ExplodeTree(Data=runapplication.Results)  # -> Branch0, Branch1

# ---- group: Element outlines and notation
deconstruct_3 = ModelDeconstruct(Model=runapplication.Model)  # -> CountryCode, Foundations, graft(Bars), Shells, LabelledSection, Panels, Loads, LoadCases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
deconstruct_modify = BarDeconstructModify(Bar=deconstruct_3.Bars)  # -> Bar, Guid, Curve, Material, Section, Connectivity, Eccentricity, LocalY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
explode = Explode(Curve=deconstruct_modify.Curve, Recursive=True)  # -> Segments, simplify(Vertices)
xprod = CrossProduct(VectorA=deconstruct_modify.Curve, VectorB=deconstruct_modify.LocalY, Unitize=deconstruct_modify.LocalY)  # -> Vector, Length
deconstruct_4 = SectionDeconstruct(Section=deconstruct_modify.Section)  # -> Guid, Name, simplify(Surfaces), SectionType, MaterialType, GroupName, TypeName, simplify(graft(SizeName))
pl = ConstructPlane(Origin=explode.Vertices, XAxis=deconstruct_modify.LocalY, YAxis=xprod.Vector)  # -> graft(Plane)
ensure_2_levels = Ensure2Levels(T=deconstruct_4.SizeName)
orient = Orient(Geometry=deconstruct_4.Surfaces, Source=PlaneXY(0, 0, 0), Target=pl)  # -> Geometry, Transform
debrep = DeconstructBrep(Brep=orient.Geometry)  # -> Faces, Edges, simplify(Vertices)
split_2 = SplitTree(Data=ensure_2_levels, Masks="{?;0}")  # -> Positive, Negative
ensure_2_levels_2 = Ensure2Levels(T=debrep.Vertices)
pline = PolyLine(Vertices=debrep.Vertices, Closed=True)
dynamic_offset = DynamicOffset(C=pline)
multiplication_8 = Multiplication(A=dynamic_offset, B=xprod.Vector)
avr = Average(Input=dynamic_offset)
move = Move(Geometry=explode.Vertices, Motion=multiplication_8)  # -> Geometry, Transform
multiplication_9 = Multiplication(A=xprod.Vector, B=avr)
midpt = CurveMiddle(Curve=explode.Segments)
relitem = RelativeItem(Tree=ensure_2_levels_2, Offset="{0;+1}", WrapPaths=False, WrapItems=False)  # -> ItemA, ItemB
pl_2 = ConstructPlane(Origin=move.Geometry, XAxis=explode.Segments, YAxis=xprod.Vector)  # -> simplify(graft(Plane))
move_2 = Move(Geometry=midpt, Motion=multiplication_9)  # -> Geometry, Transform
ln_2 = Line(StartPoint=relitem.ItemA, EndPoint=relitem.ItemB)
ensure_2_levels_3 = Ensure2Levels(T=pl_2)
not_size = Slider(0.14, range=0..0.2)
pl_3 = ConstructPlane(Origin=move_2.Geometry, XAxis=explode.Segments, YAxis=xprod.Vector)
split_3 = SplitTree(Data=ensure_2_levels_3, Masks="{?;0}")  # -> Positive, Negative
tag = TextTag3D(Location=split_3.Positive, Text=split_2.Positive, Size=not_size, Justification=7)
tag_2 = TextTag3D(Location=split_3.Negative, Text=split_2.Negative, Size=not_size, Justification=9)
tag_3 = TextTag3D(Location=pl_3, Text=deconstruct_modify.Material, Size=not_size, Justification=8)

# ---- group: Deformed shape
fembar = FiniteElementFemBar(FiniteElement=runapplication.FiniteElement)  # -> Identifier, ElementId, NodeI, NodeJ, LineGeometry
bardisplacement = BarDisplacement(Result=bang.Branch0, CaseCombinationName=disp_loadcase)  # -> CaseIdentifier, ElementId, PositionResult, Translation, Rotation
join = JoinCurves(Curves=fembar.LineGeometry, Preserve=False)  # -> simplify(Curves)
extra_split_domain = ExtraSplitDomain(P=bardisplacement.PositionResult, T=bardisplacement.Translation, B="0")  # -> P_2, T_2
midpt_2 = CurveMiddle(Curve=join)  # -> flatten(Midpoint)
remove_dup_values = RemoveDupValues(values=extra_split_domain.P_2)  # -> X_2, I
cullpt = CullDuplicates(Points=midpt_2, Tolerance=0.1, CullMode=1)  # -> Points, Indices, Valence
item_6 = ListItem(List=flatten(join), Index=cullpt.Indices, Wrap=True)  # -> simplify(graft(Item))
item_7 = ListItem(List=extra_split_domain.T_2, Index=remove_dup_values.I, Wrap=True)
scale = Slider(50, range=1..144)
eval_3 = EvaluateLength(Curve=item_6, Length=remove_dup_values.X_2, Normalized=False)  # -> Point, Tangent, Parameter
multiplication_10 = Multiplication(A=item_7, B=scale)
pl_4 = ConstructPlane(Origin=eval_3.Point, XAxis=eval_3.Tangent, YAxis="{0,1,0}")  # -> simplify(Plane)
xy = XYPlane(Origin=Point(0, 0, 0))
md_slider = MDSlider(
    SliderMode=0,
    slider_value=Point(0.05087966328, 0.1746253967, 0.5),
    x_domain=Domain(0, 2),
    y_domain=Domain(-1, 0),
    z_domain=Domain(0, 1))
orient_2 = Orient(Geometry=multiplication_10, Source=xy, Target=pl_4)  # -> Geometry, Transform
xy_2 = XYPlane(Origin=Point(0, 0, 0))
xz_2 = XZPlane(Origin=Point(0, 0, 0))
concat_4 = Concatenate(FragmentA="Scale: ", FragmentB=scale)
expression_6 = Expression(i=eval_3.Point, f=orient_2.Geometry, Expression="f-i")
orient_3 = Orient(Geometry=md_slider, Source=xy_2, Target=xz_2)  # -> Geometry, Transform
c_units = ConvertUnits(Data=orient_2.Geometry, Source=panel_3, Target=1)
pt_4 = Point("{0,0,0}")
det_size = Slider(0.1, range=0..0.2)
pdecon = Deconstruct(Point=expression_6)  # -> XComponent, YComponent, ZComponent
move_3 = Move(Geometry=pt_4, Motion=orient_3.Geometry)  # -> Geometry, Transform
xz_3 = XZPlane(Origin=move_3.Geometry)
pline_2 = PolyLine(Vertices=c_units, Closed=False)
tag_4 = TextTag3D(Location=xz_3, Text=concat_4, Size=det_size, Justification=1)
bnd = Bounds(Numbers=flatten(pdecon.ZComponent))
lng_2 = ListLength(List=pdecon.ZComponent)
abs = Absolute(Value=pdecon.ZComponent)
dedomain = DeconstructDomain(Domain=bnd)  # -> Start, End
dom_6 = ConstructDomain(DomainStart=0, DomainEnd=lng_2)
gradient = Gradient(
    LowerLimit=dedomain.Start,
    UpperLimit=dedomain.End,
    Parameter=pdecon.ZComponent,
    stops=[0: RGB(0, 0, 255), 0.333: RGB(5, 138, 95), 0.667: RGB(163, 89, 58), 1: RGB(193, 23, 10)])
expression_7 = Expression(i=dedomain.Start, a=dedomain.End, Expression="max(abs(i),a)")
range_2 = Range(Domain=dom_6, Steps=expr("x+1", lng_2))
height = Slider(0.25, range=-1.4..1.4)
width = Slider(1.6, range=0..2.8)
fsim = FindSimilarMember(Data=expression_7, Set=flatten(abs))  # -> Hit, Index
shatter = Shatter(Curve=pline_2, Parameters=range_2)
curve_preview = CustomCurvePreview(Curve=shatter, Linetype=linetype, Colour=gradient)
item_8 = ListItem(List=flatten(c_units), Index=fsim.Index, Wrap=True)
X_4 = UnitX(Factor=expr("abs(x)", [height, width]))
Z_3 = UnitZ(Factor=height)
move_4 = Move(Geometry=item_8, Motion=X_4)  # -> Geometry, Transform
division = Division(A=fsim.Hit, B=scale)
z_offset = Slider(0.057, range=0..0.4)
move_5 = Move(Geometry=move_4.Geometry, Motion=expr("-x", Z_3))  # -> Geometry, Transform
format_3 = Format(Format="{0:0.0000} mm", Culture=127, Data0=division)
pt_5 = Point([item_8, move_5.Geometry])
item_9 = ListItem(List=move_5.Geometry, Index="-1", Wrap=True)
Z_4 = UnitZ(Factor=z_offset)
pline_3 = PolyLine(Vertices=pt_5, Closed=False)
concat_5 = Concatenate(FragmentA="Maximum: ", FragmentB=format_3)
move_6 = Move(Geometry=item_9, Motion=Z_4)  # -> Geometry, Transform
xz_4 = XZPlane(Origin=move_6.Geometry)
tag_5 = TextTag3D(Location=xz_4, Text=concat_5, Size=det_size, Justification=9)

# ---- group: Plotting internal forces
c_units_2 = ConvertUnits(Data=eval_3.Point, Source=panel_3, Target=1)
pdecon_2 = Deconstruct(Point=c_units_2)  # -> XComponent, YComponent, ZComponent
bnd_2 = Bounds(Numbers=flatten(pdecon_2.XComponent))
offset = Slider(4, range=0..7)
dedomain_2 = DeconstructDomain(Domain=bnd_2)  # -> Start, End
addition_3 = Addition(A=dedomain_2.End, B=offset)
barinternalforce = BarInternalForce(Result=bang.Branch1, CaseCombinationName=disp_loadcase)  # -> CaseIdentifier, ElementId, PositionResult, Fx, Fy, Fz, Mx, My, Mz
series = Series(Start=addition_3, Step=addition_3, Count=Slider(3, range=1..4))  # -> simplify(graft(Series))
X_5 = UnitX(Factor=series)
item_10 = ListItem(List=barinternalforce.My, Index=remove_dup_values.I, Wrap=True)
bang_2 = ExplodeTree(Data=X_5)  # -> Branch0, Branch1, Branch2
c_units_3 = ConvertUnits(Data=item_10, Source=panel_3, Target=1)
S = Slider(0.26, range=0..1)
z = Slider(-2, range=-2..7)
addition_4 = Addition(A=bang_2.Branch0, B=c_units_2)
item_11 = ListItem(List=barinternalforce.Fz, Index=remove_dup_values.I, Wrap=True)
disp_forces = DispForces(local_x=eval_3.Tangent, magnitude=c_units_3, scale=S, s_point=addition_4, z_offset=z, lines=entwine_2)
S_2 = Slider(0.8, range=0..1)
z_2 = Slider(-1.5, range=-2..7)
addition_5 = Addition(A=bang_2.Branch1, B=c_units_2)
disp_forces_2 = DispForces(local_x=eval_3.Tangent, magnitude=item_11, scale=S_2, s_point=addition_5, z_offset=z_2, lines=entwine_2)
item_12 = ListItem(List=barinternalforce.Fx, Index=remove_dup_values.I, Wrap=True)
z_3 = Slider(-1.6, range=-2..7)
addition_6 = Addition(A=bang_2.Branch2, B=c_units_2)
disp_forces_3 = DispForces(local_x=eval_3.Tangent, magnitude=item_12, scale=S_2, s_point=addition_6, z_offset=z_3, lines=entwine_2)

# ---- group: Theoretical values (continued)
deconstruct_5 = SupportGroupDeconstruct(SupportGroup=construct_5)  # -> Guid, AnalyticalID, Geometry, MovingLocal, GroupLocalX, GroupLocalY, Motions, Rotations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
deconstruct_6 = RotationsDeconstruct(Rotations=deconstruct_5.Rotations)  # -> X_neg, X_pos, simplify(graft(Y_neg)), Y_pos, Z_neg, Z_pos
multiplication_11 = Multiplication(A=deconstruct_6.Y_neg, B="1E3")
bang_3 = ExplodeTree(Data=multiplication_11)  # -> Branch0, Branch1
item_13 = ListItem(List=X_5, Index="0", Wrap=True)
item_14 = ListItem(List=flatten(item_13), Index="0", Wrap=True)
eval_4 = Evaluate(
    E=expressions_for_timoshenko_semi_rigid_co,
    p=multiplication_2,
    kR=bang_3.Branch0,
    kL=bang_3.Branch1,
    x=range,
    L=len,
    E_2=multiplication_4,
    G=multiplication_3,
    A=multiplication_5,
    Iy=multiplication_6,
    Ks="5/6")
subtraction_2 = Subtraction(A=item_13, B=item_14)
branch_2 = TreeBranch(Tree=simplify(eval_4), Path="{0}", MaintainPaths=True)
bnd_3 = Bounds(Numbers=branch_2)
addition_7 = Addition(A=subtraction_2, B=X_3)
multiplication_12 = Multiplication(A=eval_4, B=graft(panel_12))
dedomain_3 = DeconstructDomain(Domain=bnd_3)  # -> MaxDefl, End
multiplication_13 = Multiplication(A=multiplication_12, B=graft([scale, S, S_2]))
Z_5 = UnitZ(Factor=multiplication_13)
max_deflection_in_m = Panel(dedomain_3.MaxDefl)
division_2 = Division(A=dedomain_3.MaxDefl, B=multiplication_2)
addition_8 = Addition(A=addition_7, B=Z_5)
expression_8 = Expression(x=division_2, Expression="x*1E3/1E-3")
pline_4 = PolyLine(Vertices=addition_8, Closed=False)
transverse_stiffness_in_mm_kn = Panel(expression_8)

# ---- group: Traditional Colibri (continued)
colibri_out = ColibriOutputs(Transverse_flexibility_Te=flatten(expression_8), Transverse_flexibility=flatten(division))

# ---- group: Parametric analysis (continued)
colibri_out_2 = ColibriOutputs(
    Transverse_flexibility_TE=flatten(dedomain_3.MaxDefl),
    Transverse_flexibility=flatten(division),
    Length=flatten(item.Item),
    Stiffness_index=flatten(item.Item1),
    Elasticity_modulus=flatten(item.Item2),
    Height=flatten(item.Item3))
ca = ColibriAggregator(
    Folder=create_folder_s.path,
    Inputs=colibri_in_2.IP,
    Outputs=colibri_out,
    ImageSetting=set_img,
    Write=Toggle(False),
    recordingMode=0)

# ---- group: Theoretical values / Limiting display
branch_3 = TreeBranch(Tree=simplify(pline_4), Path="{0}", MaintainPaths=True)

# ---- group: Theoretical values (continued)
curve_preview_2 = CustomCurvePreview(Curve=branch_3, Linetype=linetype_2, Colour=RGB(0, 0, 0))

# ==== cluster ExtraSplitDomain
P = ClusterInput()
T = ClusterInput()
B = ClusterInput()
equals = Equality(FirstNumber=P, SecondNumber=B)  # -> Equality, Inequality
lng = ListLength(List=P)
series = Series(Start=0, Step=1, Count=lng)
expression = Expression(x=lng, Expression="x-1")
cull = CullPattern(List=series, CullPattern=equals.Equality)
expression_2 = Expression(x=cull, Expression="x-1")
ins = InsertItems(List=expression_2, Item=expression, Indices="-1", Wrap=True)
cull_i = CullIndex(List=ins, Indices="0", Wrap=True)
dom = ConstructDomain(DomainStart=cull, DomainEnd=cull_i)
subset = SubList(List=P, Domain=dom, Wrap=True)  # -> simplify(List), Index
subset_2 = SubList(List=T, Domain=dom, Wrap=True)  # -> simplify(List), Index
T_2 = ClusterOutput(subset_2.List)
item = ListItem(List=subset.List, Index="-1", Wrap=True)
subtraction = Subtraction(A=item, B="0.001")
replace = ReplaceItems(List=subset.List, Item=subtraction, Indices="-1", Wrap=True)
P_2 = ClusterOutput(replace)

# ==== cluster DispForces
s_point = ClusterInput()
pdecon = Deconstruct(Point=flatten(s_point))  # -> XComponent, YComponent, ZComponent
bnd = Bounds(Numbers=pdecon.XComponent)  # -> flatten(Domain)
x_offset = Slider(0.65, range=0.1..1)
dedomain = DeconstructDomain(Domain=bnd)  # -> Start, End
z_offset = ClusterInput()
addition = Addition(A=dedomain.Start, B=x_offset)
Z = UnitZ(Factor=z_offset)  # -> simplify(graft(UnitVector))
spacing = Slider(0.24, range=0..1)
X = UnitX(Factor=addition)
no_legends = Slider(5, range=3..7)
addition_2 = Addition(A=X, B=Z)
Z_2 = UnitZ(Factor=spacing)
magnitude = ClusterInput()
pdecon_2 = Deconstruct(Point=addition_2)  # -> XComponent, YComponent, ZComponent
dcon = DeleteConsecutive(Set=magnitude, Wrap=False)  # -> Set, Count
series = Series(Start=pdecon_2.ZComponent, Step=Z_2, Count=no_legends)
local_x = ClusterInput()
pt = ConstructPoint(XCoordinate=pdecon_2.XComponent, YCoordinate=pdecon_2.YComponent, ZCoordinate=series)
scale = ClusterInput()
lines = ClusterInput()
xprod = CrossProduct(VectorA=local_x, VectorB="{0,-1,0}", Unitize=True)  # -> Vector, Length
multiplication = Multiplication(A=dcon.Set, B=scale)
offset = Slider(0.1, range=0..1)
bang = ExplodeTree(Data=simplify(lines))  # -> Branch0, Branch1, Branch2, Branch3, Branch4
item = ListItem(List=pt, Index=[0, -1], Wrap=True)
line_length = Slider(0.7, range=0..1)
multiplication_2 = Multiplication(A=xprod.Vector, B=multiplication)
X_2 = UnitX(Factor=offset)
bnd_2 = Bounds(Numbers=flatten(dcon.Set))
move = Move(Geometry=s_point, Motion=multiplication_2)  # -> Geometry, Transform
pline = PolyLine(Vertices=s_point, Closed=False)
lng = ListLength(List=dcon.Set)
move_2 = Move(Geometry=pt, Motion=X_2)  # -> Geometry, Transform
X_3 = UnitX(Factor=line_length)
curve_preview = CustomCurvePreview(Curve=pline, Linetype=bang.Branch3, Colour=RGB(0, 0, 0))
dom = ConstructDomain(DomainStart=0, DomainEnd=lng)
range = Range(Domain=bnd_2, Steps=expr("x-1", no_legends))  # -> simplify(Range)
ln = Line(StartPoint=s_point, EndPoint=move.Geometry)
move_3 = Move(Geometry=move_2.Geometry, Motion=X_3)  # -> Geometry, Transform
dedomain_2 = DeconstructDomain(Domain=bnd_2)  # -> Start, End
pline_2 = PolyLine(Vertices=move.Geometry, Closed=False)
range_2 = Range(Domain=dom, Steps=lng)
ln_2 = Line(StartPoint=move_2.Geometry, EndPoint=move_3.Geometry)
item_2 = ListItem(List=move_3.Geometry, Index=[0, -1], Wrap=True)
gradient = Gradient(
    LowerLimit=dedomain_2.Start,
    UpperLimit=dedomain_2.End,
    Parameter=dcon.Set,
    stops=[0: RGB(0, 0, 255), 0.333: RGB(5, 138, 95), 0.667: RGB(163, 89, 58), 1: RGB(193, 23, 10)])
gradient_2 = Gradient(
    LowerLimit=dedomain_2.Start,
    UpperLimit=dedomain_2.End,
    Parameter=range,
    stops=[0: RGB(0, 0, 255), 0.333: RGB(5, 138, 95), 0.667: RGB(163, 89, 58), 1: RGB(193, 23, 10)])
pt_2 = Point([item_2, item])
shatter = Shatter(Curve=pline_2, Parameters=range_2)
fcircle = CircleFit(Points=pt_2)  # -> Circle, Radius, Deviation
avr = Average(Input=pt_2)
Z_3 = UnitZ(Factor=1)
format = Format(Format="{0:0.0}", Culture=127, Data0=range)
alongcrv = SortAlongCurve(Points=pt_2, Curve=fcircle.Circle)  # -> Points, Indices
pl = ConstructPlane(Origin=avr, XAxis=Vector(1, 0, 0), YAxis=Z_3)
pline_3 = PolyLine(Vertices=alongcrv.Points, Closed=True)
curve_preview_2 = CustomCurvePreview(Curve=ln, Linetype=bang.Branch0, Colour=gradient)
curve_preview_3 = CustomCurvePreview(Curve=shatter, Linetype=[bang.Branch3, bang.Branch0], Colour=gradient)
scale_nu = ScaleNU(Geometry=pline_3, Plane=pl, ScaleX=Slider(1.9, range=1..2), ScaleY=Slider(1.4, range=1..2), ScaleZ=1)  # -> Geometry, Transform
shift = Slider(0.288, range=0..1)
Z_4 = UnitZ(Factor=1)
X_4 = UnitX(Factor=expr("-x", shift))
pl_2 = ConstructPlane(Origin=pt, XAxis=Vector(1, 0, 0), YAxis=Z_4)
move_4 = Move(Geometry=scale_nu.Geometry, Motion=X_4)  # -> Geometry, Transform
tag = TextTag3D(Location=pl_2, Text=format, Size=0.14, Colour=gradient_2, Justification=6)
curve_preview_4 = CustomCurvePreview(Curve=ln_2, Linetype=bang.Branch2, Colour=gradient_2)
curve_preview_5 = CustomCurvePreview(Curve=move_4.Geometry, Linetype=bang.Branch1, Colour=bang.Branch4)

# ==== cluster RemoveDupValues
values = ClusterInput()
X = UnitX(Factor=values)
cullpt = CullDuplicates(Points=X, Tolerance=0.1, CullMode=1)  # -> Points, Indices, Valence
I = ClusterOutput(cullpt.Indices)
pdecon = Deconstruct(Point=cullpt.Points)  # -> XComponent, YComponent, ZComponent
X_2 = ClusterOutput(pdecon.XComponent)

# ==== cluster Ensure2Levels
T = ClusterInput()
tstat = TreeStatistics(Tree=T)  # -> Paths, Length, Count
dpath = DeconstructPath(Branch=tstat.Paths)
lng = ListLength(List=dpath)  # -> flatten(Length)
ins = InsertItems(List=dpath, Item="0", Indices="0", Wrap=True)
path = ConstructPath(Indices=ins)  # -> flatten(Branch)
item = ListItem(List=lng, Index=0, Wrap=True)
replace = ReplacePaths(Data=T, Search=tstat.Paths, Replace=path)
pshift = ShiftPaths(Data=replace, Offset=expr("x-1", item))
D = ClusterOutput(pshift)

# ==== cluster ExpressionsForTimoshenkoSemiRigidConnections
# Deflection field using Euler-Bernoulli beam theory: x*p*((x*kL/2 + E*Iy)*kR*L^3/6 + ((E*Iy)^2 + x*(kL + kR/3)*E*Iy/2 - x^2*kL*kR/12)*L^2 + x*E*Iy*(E*Iy - x*(kL + kR)/3)*L - (E*Iy)^2*x^2)*(L - x) / (24*E*Iy*(L^2*kL*kR/12 + E*Iy*(kL + kR)*L/3 + (E*Iy)^2))
deflection_field_using_timoshenko_ehrenf = Panel("((12*E^3*(A*G*Ks*L + kL + kR)*Iy^3 + E^2*(A^2*G^2*L*(L^2 + L*x - x^2)*Ks^2 + 5*(kL + kR)*(L^2 + 1/5*x*L - 1/5*x^2)*G*A*Ks + 12*L*kL*kR)*Iy^2 + Ks*(G*(L^2*kR + 3*x*(kL + kR/3)*L - 2*x^2*(kL + kR))*A*L*Ks + 6*kL*kR*(L^2 + L*x - x^2))*G*A*E*L*Iy/6 + A^2*G^2*L^3*x*Ks^2*kL*kR*(L - x)/12)*x*(L - x)*p)/(24*Ks*G*A*E*Iy*(E^2*(A*G*Ks*L + kL + kR)*Iy^2 + E*(A*G*Ks*(kL + kR)*L + 3*kL*kR)*L*Iy/3 + A*G*Ks*L^3*kL*kR/12))")  # "Deflection field using Timoshenko–Ehrenfest beam theory"
internal_bending_moment = Panel("6*(x*E^2*(x - L)*(A*G*Ks*L + kL + kR)*Iy^2 + ((A*G*Ks*L^3*kL/4 + (((-(5*x*A*G*Ks)/2 + kR)*kL - (3*x*A*G*Ks*kR)/2)*L^2)/2 + x*((A*G*Ks*x - 3*kR)*kL + x*A*G*Ks*kR)*L + 3*x^2*kL*kR)*L*E*Iy)/3 + A*G*kL*L^3*kR*(x^2 - x*L + 1/6*L^2)*Ks/12)*p/(12*E^2*(A*G*Ks*L + kL + kR)*Iy^2 + 4*(A*G*(kL + kR)*Ks*L + 3*kL*kR)*L*E*Iy + A*G*Ks*L^3*kL*kR)")
internal_shear_force = Panel("-24*((x - L/2)*E^2*(A*G*Ks*L + kL + kR)*Iy^2 + L*(-(5*A*G*(kL + (3*kR)/5)*Ks*L^2)/8 + (x*A*G*(kL + kR)*Ks - (3*kL*kR)/2)*L + 3*kL*kR*x)*E*Iy/3 + A*G*kL*L^3*(x - L/2)*kR*Ks/12)*p/(24*E^2*(A*G*Ks*L + kL + kR)*Iy^2 + 8*(A*G*(kL + kR)*Ks*L + 3*kL*kR)*L*E*Iy + 2*A*G*Ks*L^3*kL*kR)")
entwine = Entwine(
    Branch00=deflection_field_using_timoshenko_ehrenf,
    Branch01=internal_bending_moment,
    Branch02=internal_shear_force,
    FlattenInputs=True)
R = ClusterOutput(entwine)

# ==== cluster ChangeValueListSection
alltypes = ClusterInput()
find = ClusterInput()
txt = Text(alltypes)
tmatch = MatchText(Text=txt, RegEx=find, Case=True)
cull = CullPattern(List=txt, CullPattern=tmatch)
split = TextSplit(Text=cull, Separators="x")
item = ListItem(List=split, Index="1", Wrap=True)  # -> flatten(Item)
sort = SortList(Keys=item)  # -> Keys, ValuesA
larger = LargerThan(FirstNumber=sort.Keys, SecondNumber="70")  # -> LargerThan, OrEqualTo
cull_2 = CullPattern(List=sort.Keys, CullPattern=larger.OrEqualTo)
pvl = PopulateValueList(Name="CC Height", Values=cull, Keys=cull_2)  # inputs Name: String, Values: list of String, Keys: list of String
# ---------- pvl: Python ----------
ghenv.Component.Name = "PopulateValueList"
ghenv.Component.NickName = "PVL"

import Grasshopper as gh

# All objects in Grasshopper script
currentObj = ghenv.Component.OnPingDocument().Owner.OwnerDocument().Objects
# Alternativly remove ".Owner.OwnerDocument()" if not clustered

# Looking thorugh all objects
for obj in currentObj:

    # Only object in the GrassHopper Interface
    if type(obj) is gh.Kernel.IGH_DocumentObject:

        # Only the object by the desired name
        if obj.NickName == Name:

            # Clearing values
            obj.ListItems.Clear()

            # Applying desired values and keys
            for k, v in zip(Keys, Values):
                vli = gh.Kernel.Special.GH_ValueListItem(str(k), str('"' + k + '"'))
                obj.ListItems.Add(vli)
            
            # Ensure downstream objects are refreshed
            obj.ExpireSolution(True)
# ---------- end pvl ----------

# ==== cluster ChangeValueListMat
alltypes = ClusterInput()
find = ClusterInput()
txt = Text(alltypes)
tmatch = MatchText(Text=txt, RegEx=find, Case=True)
cull = CullPattern(List=txt, CullPattern=tmatch)
cull_i = CullIndex(List=cull, Indices=-1, Wrap=True)
pvl = PopulateValueList(Values=cull_i, Name="TimberType")  # inputs Values: list of String, Name: String
# ---------- pvl: Python ----------
ghenv.Component.Name = "PopulateValueList"
ghenv.Component.NickName = "PVL"

import Grasshopper as gh

# All objects in Grasshopper script
currentObj = ghenv.Component.OnPingDocument().Owner.OwnerDocument().Objects
# Alternativly remove ".Owner.OwnerDocument()" if not clustered

for obj in currentObj:
    print(obj.NickName)
    if type(obj) is gh.Kernel.IGH_DocumentObject:
        if obj.NickName == Name:
            obj.ListItems.Clear()
            for k in Values:
                vli = gh.Kernel.Special.GH_ValueListItem(str(k), str('"' + k + '"'))
                obj.ListItems.Add(vli)
            obj.ExpireSolution(True)
# ---------- end pvl ----------

# ==== cluster DynamicOffset
C = ClusterInput()
explode = Explode(Curve=C, Recursive=True)  # -> Segments, Vertices
item = ListItem(List=explode.Segments, Index="0", Wrap=True)
len = Length(Curve=item)
offset = Slider(0.05, range=0..0.1)
division = Division(A=len, B="2")
addition = Addition(A=division, B=offset)  # -> simplify(Result)
ensure_2_levels = Ensure2Levels(T=addition)
pshift = ShiftPaths(Data=ensure_2_levels, Offset="-1")
D = ClusterOutput(pshift)
