# Grasshopper definition HoriStab2.gh (Grasshopper 1.0.8)
# plug-ins: CORE.Grasshopper.Colibri, FEM-Design

# ---- group: Monte Carlo analysis / Names of all parameters
connection_parameters = Panel("""Column, base
Corner
Beam, apex
Interm., base""")
geometric_parameters = Panel("""Span
Height""")
material_parameters = Panel("""Frame
Intermediate""")
cross_section_parameters = Panel("""Width
Column, base
Column, corner
Beam, corner
Beam, apex""")
special_parameters = Panel("""Bracing, mat
Bracing, size""")
dynamic_parameters = Panel("""Interm., size
Interm., spacing
Pitch
Interm., number""")

# ---- group: Normally distributed
random = Random(Range="0 To 1", Number="1000", Seed="213125", Integers=False)
dedomain = DeconstructDomain(Domain="360 To 1845")  # -> Start, End
num = Number("360 + 45*12")
py3 = Python3Script(std="350", mu=num, u=random, s=dedomain.Start, e=dedomain.End)  # -> out, d; inputs std: Double, mu: Double, u: list, s: Double, e: Double
# ---------- py3: Python ----------
import System
import Rhino
import Grasshopper

import rhinoscriptsyntax as rs
import pkg_resources

import numpy as np
from scipy.stats import truncnorm

def TruncNorm(sample, mean=5, std=1, lower=2, upper=7):

    # Computing bounds
    a, b = (lower - mean) / std, (upper - mean) / std

    # Truncated normally distributed data
    NormData = truncnorm.ppf(sample, a, b, loc=mean, scale=std)

    return NormData


class MyComponent(Grasshopper.Kernel.GH_ScriptInstance):
    def RunScript(self,
            std: float,
            mu: float,
            u: System.Collections.Generic.List[object],
            s: float,
            e: float):
        

        # Convert .NET List[float] to a Python list of floats
        u = list(u)

        NormData = TruncNorm(u, mu, std, s, e)

        print(np.shape(NormData))
        print(type(NormData))

        return NormData.tolist()
# ---------- end py3 ----------
bar_graph = BarGraph(py3.d, BarColor=RGB(255, 0, 90))

# ---- group: Custom material, GLh/c / Working directory + file
current_folder_file = Python3Script(filename="CustomMat.struxml")  # -> path; inputs filename: String
# ---------- current_folder_file: Python ----------
"""Grasshopper Script Instance"""
import System
import Rhino
import Grasshopper

import rhinoscriptsyntax as rs

class MyComponent(Grasshopper.Kernel.GH_ScriptInstance):
    def RunScript(self, filename: str):

        # Get the current document path
        folder = rs.DocumentPath() 

        # Define the file path
        path = folder + str(filename)

        return path
# ---------- end current_folder_file ----------

# ----
knm_rad = Panel("1")
rad = Radians(Degrees=knm_rad)
knm_deg = Panel(rad)
rigid = ConnectivityRigid()
hinged = ConnectivityHinged()
panel = Panel("""-1.7
-0.9
-0.5""")
panel_2 = Panel("""-1.2
-0.8
-0.5""")
panel_3 = Panel("""-0.6
-0.3
-0.2""")
panel_4 = Panel("""0.0
0.0
0.0""")
panel_5 = Panel("""0.2
0.0
0.0""")

# ---- group: Load cases
load_cases = Panel("WIND")
concat = Concatenate(FragmentA=load_cases, FragmentB="-ordinary-permanent")
split = TextSplit(Text=concat, Separators="-")
panel_6 = Panel(concat)
item = ListItem(List=split, Index=0, Wrap=True)  # -> Item, Item1, Item2
construct = LoadCaseConstruct(Name=item.Item, Type=item.Item1, DurationClass=item.Item2)  # -> flatten(LoadCase)

# ---- group: Load combinations
list = ValueList({"ultimate_ordinary", "ultimate_accidental", "ultimate_seismic", "serviceability_quasi_permanent", "serviceability_frequent", "serviceability_characteristic"}, selected="ultimate_ordinary")
construct_2 = LoadCombinationConstruct(Name="ULS_DL", Type=list, LoadCase=construct, Gamma="1.00")  # -> flatten(LoadCombination)

# ---- group: Results
resultstype = ResultsType({"NodalDisplacement", "PointSupportReaction", "PointSupportReactionMinMax", "LineSupportReaction", "LineSupportResultant", "SurfaceSupportReaction", "SurfaceSupportResultant", "BarInternalForce", "BarDisplacement", "BarEndForce"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}, selected="BarDisplacement")
resultstype_2 = ResultsType({"NodalDisplacement", "PointSupportReaction", "PointSupportReactionMinMax", "LineSupportReaction", "LineSupportResultant", "SurfaceSupportReaction", "SurfaceSupportResultant", "BarInternalForce", "BarDisplacement", "BarEndForce"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}, selected="BarInternalForce")
analysis = AnalysisDefine(CalcCase=Toggle(False), CalcComb=True, CalcGmax=False, CalcDesign=False, Elemfine=True, Diaphragm=0, PeakSmoothing=False)
merge = Merge(Data1=resultstype, Data2=resultstype_2)

# ---- group: Options
panel_7 = Panel("Millimeters")
create_folder_and_return_path = Python3Script(FileName="Frame_bar.str", FolderName="SavedModels")  # -> out, path; inputs FileName: String, FolderName: String
# ---------- create_folder_and_return_path: Python ----------
"""Grasshopper Script Instance"""
import System
import Rhino
import Grasshopper

import rhinoscriptsyntax as rs
import os

class MyComponent(Grasshopper.Kernel.GH_ScriptInstance):
    def RunScript(self, FileName: str, FolderName: str):

        # Get the current document path
        folder = rs.DocumentPath() 

        # Define the folder path
        save_folder = os.path.join(folder, FolderName)

        # Create folder if it doesn't exist
        if not os.path.exists(save_folder):
            os.makedirs(save_folder)
            print(f"Created missing folder: {save_folder}")

        # Define the model file path
        file_path = os.path.join(save_folder, FileName)

        return file_path
# ---------- end create_folder_and_return_path ----------
rep = ReplaceText(Text=panel_7, Find=panel_7, Replace="mm", RecursiveReplace=False)
units = Units(Length=rep, Angle="rad", SectionalData="m", Force="kN", Mass="kg", Displacement="mm", Stress="Pa")
change_no_element_division = Python3Script(NumElem=Slider(7, range=2..21))  # -> out, path; inputs NumElem: Int32
# ---------- change_no_element_division: Python ----------
"""Grasshopper Script Instance"""
import System
import Rhino
import Grasshopper

import rhinoscriptsyntax as rs
import xml.etree.ElementTree as ET
import os

# Default XML content
DEFAULT_XML_CONTENT = """<?xml version="1.0" encoding="UTF-8"?>
<!-- (c) StruSoft 2012-2021, http://www.strusoft.com -->
<cmdglobalcfg command="$ FEM $CODE(GLOBALCFG)">
    <!-- modify the value below if you want to change the Globalcfg setting -->
    <!-- attributes that start with 'f' must be 0 or 1 -->
    <!-- attributes that start with 'r' are double numbers -->
    <!-- attributes that start with 's' are integer numbers -->
    <soil_calculation
        fSoilAsSolid = "0" />
    <mesh_general
        fAdjustToLoads = "0" />
    <mesh_elements
        fElemCalcRegion = "1"
        rElemSizeDiv = "6.0"
        fCorrectToMinDivNum = "1"
        sDefaultDivision = "2"
        rDefaultAngle = "15.0" />
    <mesh_functions
        fRefineLocally = "1"
        sRefineMaxStepNum = "5"
        fMaxIterWarning = "0"
        fReduceSize = "1"
        sSmoothStepNum = "3"
        fCheckMeshGeom = "1"
        rCheckGeomMinAngle = "10.0"
        rCheckGeomMaxAngle = "170.0"
        rCheckGeomMaxSideRatio = "8.0"
        fCheckMeshOverlap = "1"
        fCheckMeshTopology = "1" />
    <mesh_prepare
        fAutoRegen = "1"
        fThPeak = "1"
        fThBeam = "0"
        fThColumn = "1"
        fThTruss = "0"
        fThFicBeam = "0"
        fThFreeEdge = "0"
        fThRegionBorder = "0"
        fThSuppPt = "1"
        fThSuppLn = "0"
        fThSuppSf = "0"
        fThEdgeConn = "0"
        fThConnPt = "0"
        fThConnLn = "0"
        fThConnSf = "0"
        fThLoadPt = "0"
        fThLoadLn = "0"
        fThLoadSf = "0"
        fThFixPt = "0"
        fThFixLn = "0"
        fAutoRebuild = "1"
        fAutoSmooth = "1"
        fAutoCheck = "0" />
    <peaksm_method
        sPeakFormFunc_M = "1"
        sPeakFormFunc_N = "1"
        sPeakFormFunc_V = "1" />
    <peaksm_auto
        fPeakBeam = "0"
        fPeakColumn = "1"
        fPeakTruss = "0"
        fPeakFicBeam = "0"
        fPeakPlate = "0"
        fPeakWall = "0"
        fPeakFicShell = "0"
        fPeakSuppPt = "1"
        fPeakSuppLn = "0"
        fPeakSuppSf = "0"
        fPeakConnPt = "0"
        fPeakConnLn = "0"
        fPeakConnSf = "0"
        rPeakFactor = "0.5" />
</cmdglobalcfg>"""

class MyComponent(Grasshopper.Kernel.GH_ScriptInstance):
    def RunScript(self, NumElem: int):

        # Get the current document path
        folder = rs.DocumentPath() 

        # Define the GlobalConfig folder path
        global_config_folder = os.path.join(folder, "GlobalConfig")

        # Create GlobalConfig folder if it doesn't exist
        if not os.path.exists(global_config_folder):
            os.makedirs(global_config_folder)
            print(f"Created missing folder: {global_config_folder}")

        # Define the XML file path
        xml_file = os.path.join(global_config_folder, "cmdglobalcfg.xml")

        # If the XML file doesn't exist, create it with default content
        if not os.path.exists(xml_file):
            with open(xml_file, "w", encoding="UTF-8") as f:
                f.write(DEFAULT_XML_CONTENT)
            print(f"Created missing file: {xml_file}")
        
        # Parse the XML file
        tree = ET.parse(xml_file)
        root = tree.getroot()
        
        # Find the mesh_elements tag and update the sDefaultDivision attribute
        for elem in root.findall("mesh_elements"):
            if "sDefaultDivision" in elem.attrib:
                elem.set("sDefaultDivision", str(NumElem))
                print(f"Updated sDefaultDivision to {NumElem}")
        
        # Create a new filename with the new value in the GlobalConfig folder
        new_filename = os.path.join(global_config_folder, f"cmdglobalcfg_{NumElem}.xml")
        
        # Save the modified XML to the new file
        tree.write(new_filename, encoding="UTF-8", xml_declaration=True)

        return new_filename
# ---------- end change_no_element_division ----------

# ----
disp_loadcase = Panel("WIND")

# ---- group: Line types / Outline (legend)
swatch = ColourSwatch(SwatchColor=RGB(107, 107, 107))
linetype = ModelLinetype(Name="ol", CapStyle="1", JoinStyle="1", Width=Slider(0.02, range=0.01..0.1))

# ---- group: Line types / Legend "lines"
linetype_2 = ModelLinetype(Name="ll", CapStyle="1", JoinStyle="1", Width=Slider(0.25, range=0.01..0.3))

# ---- group: Line types / Actual
linetype_3 = ModelLinetype(Name="ac", CapStyle="0", JoinStyle="1", Width=Slider(0.07, range=0.01..0.1))

# ---- group: Line types / Expected
space = Slider(0.06, range=0.01..0.3)
panel_8 = Panel("""1
-1""")
multiplication = Multiplication(A="50", B=panel_8)
linetype_4 = ModelLinetype(Name="ex", Segments=multiplication, CapStyle="1", JoinStyle="1", Width=Slider(0.02, range=0.01..0.1))

# ---- group: Line types / Model lines
linetype_5 = ModelLinetype(Name="ml", CapStyle="0", JoinStyle="1", Width=Slider(0.02, range=0.01..0.3))

# ---- group: Line types
entwine = Entwine(Branch00=linetype_3, Branch01=linetype, Branch02=linetype_2, Branch03=linetype_5, Branch04=swatch, FlattenInputs=True)
linetype_6 = ModelLinetype([linetype_3, linetype_4, linetype, linetype_2, linetype_5])

# ----
panel_9 = Panel("""0
1
0""")

# ---- group: Monte Carlo analysis
txt = Text([geometric_parameters, material_parameters, cross_section_parameters, connection_parameters, special_parameters, dynamic_parameters])
no_objects = DigitScroller(Scroller_Digits=12, Scroller_Prefix="No. objects", Scroller_Radix=11, Scroller_Value=14700)
lng = ListLength(List=txt)
no_param = Panel(lng)
currentobject = Slider(5513, range=0..14699)
smns = SetMaxNumberSlider(Name="CurrentObject", Max=no_objects)  # inputs Name: String, Max: Int32
# ---------- smns: Python ----------
ghenv.Component.Name = "SetMaxNumberSlider"
ghenv.Component.NickName = "SMNS"

import Grasshopper as gh
import System

# All objects in Grasshopper script
currentObj = ghenv.Component.OnPingDocument().Objects
# Alternativly add ".Owner.OwnerDocument().Objects" if in cluster

# Looking thorugh all objects
for obj in currentObj:

    # Only object in the GrassHopper Interface
    if type(obj) is gh.Kernel.IGH_DocumentObject:

        # Only the object by the desired name
        if obj.NickName == Name:

            # Study objects
            # print(obj.Slider.Maximum)
            # print(dir(obj.Slider))

            # Setting to integre
            obj.Slider.DecimalPlaces = System.Decimal(0)

            # Setting limits
            obj.Slider.Minimum = System.Decimal(0)
            obj.Slider.Maximum = System.Decimal(Max-1)
            
            # Ensure downstream objects are refreshed
            obj.ExpireSolution(True)
# ---------- end smns ----------

# ---- group: Monte Carlo analysis / Parameters with static ranges and bias
static_ranges = Panel("""7 To 63
2 To 7
10.4 To 13.5
8.4 To 14.2
90 To 215
360 To 1845
360 To 1845
360 To 1845
360 To 1845
0 To 40
0 To 40
0 To 40
0 To 40""")
bias = Panel("""1
1/3
1
1
0.4
0.8
0.8
0.8
0.8
3
3
3
3""")
lng_2 = ListLength(List=static_ranges)
random_2 = Random(Range="0 To 10000", Number=lng, Seed="562657412", Integers=True)
split_2 = SplitList(List=random_2, Index=lng_2)  # -> ListA, ListB
split_3 = SplitList(List=split_2.ListB, Index="2")  # -> ListA, ListB
power_function = Panel("s + (e - s)*u^b")
random_3 = Random(Range="0 To 1", Number=no_objects, Seed=split_2.ListA, Integers=False)
dedomain_2 = DeconstructDomain(Domain=static_ranges)  # -> Start, End
eval = Evaluate(E=power_function, b=graft(bias), u=random_3, s=graft(dedomain_2.Start), e=graft(dedomain_2.End))  # -> simplify(R)

# ---- group: Monte Carlo analysis / Estimated time
time_per_calc = Panel("18")
eval_2 = Evaluate(E="N*t/(60*60)", N=no_objects, t=time_per_calc)
approx_completion_time = Panel(eval_2)

# ---- group: Checking distribution of individual parameters
number_slider = Slider(10, range=0..12)
item_2 = ListItem(Names=txt, Index=number_slider, Wrap=True)
branch = TreeBranch(Tree=eval, Path=number_slider, MaintainPaths=True)
bar_graph_2 = BarGraph(branch, BarColor=RGB(255, 0, 90))
panel_10 = Panel(item_2)

# ---- group: Checking distribution of Iy
height = Slider(6, range=5..8)
index_of_width = Panel("4")
branch_2 = TreeBranch(Tree=eval, Path=[height, index_of_width], MaintainPaths=True)
bang = ExplodeTree(Data=branch_2)  # -> Branch0, Branch1
expression = Expression(b=bang.Branch0, h=bang.Branch1, Expression="1/12*b*h^3*1E-8")
larger = LargerThan(FirstNumber="1000", SecondNumber=expression)  # -> LargerThan, OrEqualTo
bar_graph_3 = BarGraph(expression, BarColor=RGB(255, 0, 90))
ma = MassAddition(Input=larger.LargerThan)  # -> Result, PartialResults
panel_11 = Panel(ma.Result)

# ---- group: Monte Carlo analysis (continued)
item_3 = ListItem(List=split_3.ListA, Index=0, Wrap=False)  # -> Item, Item1
data = Data(eval)

# ---- group: Monte Carlo analysis / Bracing parameters
graft = GraftTree(Tree=[item_3.Item, item_3.Item1], IncludeEmptyLists=True, IncludeNullItems=True)
data_2 = Data(Tree({0}: ["210 To 210", "8.4 To 14.2"], {1}: ["80 To 1810", "8100 To 27225"]))
random_4 = Random(Range=data_2, Number=no_objects, Seed=graft, Integers=False)  # -> simplify(Random)
mat_and_cc_for_bracing = Panel(data_2)
random_5 = Random(Range="0 To 1", Number=no_objects, Seed="47", Integers=True)  # -> simplify(Random)
split_4 = SplitTree(Data=random_4, Masks=flatten("{?;0}"))  # -> Positive, Negative
equals = Equality(FirstNumber=random_5, SecondNumber="1")  # -> Equality, Inequality
p_n_c = PickNChoose(Pattern=equals.Equality, Stream0=split_4.Positive, Stream1=split_4.Negative)  # -> simplify(Result)
offset_path_numbering = OffsetPathNumbering(existing_tree=data, tree=p_n_c)

# ---- group: Monte Carlo analysis (continued)
data_3 = Data([data, offset_path_numbering])
data_4 = Data(data_3)

# ---- group: Monte Carlo analysis / Dynamic ranges and/or bias
index_of_span_width = Panel("""0
4""")
interm_height_interm_spacing_roof_pitch = Panel("""Format("{0} To {1}",b/2,b*3)
Format("{0} To {1}",L/12,L/4)
Format("0 To 25", 1)""")
branch_3 = TreeBranch(Tree=data_3, Path=index_of_span_width, MaintainPaths=True)
bang_2 = ExplodeTree(Data=branch_3)  # -> Branch0, Branch1
eval_3 = Evaluate(E=graft(interm_height_interm_spacing_roof_pitch), L=bang_2.Branch0, b=bang_2.Branch1)  # -> simplify(R)
bnd = Bounds(Numbers=bang_2.Branch0)
lng_3 = ListLength(List=bang_2.Branch0)
split_5 = SplitList(List=split_3.ListB, Index="3")  # -> ListA, ListB
dup = DuplicateData(Data="1/4", Number=lng_3, Order=True)
remap = RemapNumbers(Value=bang_2.Branch0, Source=bnd, Target="1 To 3")  # -> Mapped, Clipped
remap_2 = RemapNumbers(Value=bang_2.Branch0, Source=bnd, Target="2 To 0.3")  # -> Mapped, Clipped
entwine_2 = Entwine(Branch00=dup, Branch01=remap.Mapped, Branch02=remap_2.Mapped, FlattenInputs=True)
random_6 = Random(Range="0 To 1", Number=no_objects, Seed=split_5.ListA, Integers=False)
dedomain_3 = DeconstructDomain(Domain=eval_3)  # -> Start, End
power_function_2 = Panel("s + (e - s)*u^b")
eval_4 = Evaluate(E=power_function_2, b=entwine_2, u=random_6, s=dedomain_3.Start, e=dedomain_3.End)  # -> simplify(R)

# ---- group: Checking norm. span vs. spacing
length = Number(bang_2.Branch0)
bnd_2 = Bounds(Numbers=length)
dedomain_4 = DeconstructDomain(Domain=bnd_2)  # -> Start, End
division = Division(A=length, B=dedomain_4.End)

# ---- group: Monte Carlo analysis (continued)
offset_path_numbering_2 = OffsetPathNumbering(existing_tree=data_4, tree=eval_4)
data_5 = Data([data_4, offset_path_numbering_2])
data_6 = Data(data_5)

# ---- group: Monte Carlo analysis / Number of intermediate columns
span = Panel("0")
branch_4 = TreeBranch(Tree=data_5, Path=span, MaintainPaths=True)
spacing_index = Panel("1")
bnd_3 = Bounds(Numbers=branch_4)
remap_3 = RemapNumbers(Value=branch_4, Source=bnd_3, Target="2 To 0.05")  # -> Mapped, Clipped
branch_5 = TreeBranch(Tree=eval_4, Path=spacing_index, MaintainPaths=False)
power_function_3 = Panel("s + (e - s)*u^b")
random_7 = Random(Range="0 To 1", Number=no_objects, Seed=split_5.ListB, Integers=False)
eval_5 = Evaluate(E="Format(\"0 To {0}\",Floor(L/2/s))", L=branch_4, s=branch_5)
dedomain_5 = DeconstructDomain(Domain=eval_5)  # -> Start, End
eval_6 = Evaluate(E=power_function_3, b=remap_3.Mapped, u=random_7, s=dedomain_5.Start, e=dedomain_5.End)  # -> simplify(R)
round = Round(Number=eval_6)  # -> Nearest, Floor, Ceiling

# ---- group: Checking norm. span vs. spacing / Spacing
length_2 = Number(branch_5)

# ---- group: Checking norm. span vs. spacing (continued)
division_2 = Division(A=length_2, B=length)
concat_2 = Concatenate(FragmentA=division, FragmentB=division_2, JoinSeparator="-")
panel_12 = Panel(concat_2)

# ---- group: Visualizing distribution
branch_6 = TreeBranch(Tree=data_5, Path=Slider(15, range=15..17), MaintainPaths=True)
pt = ConstructPoint(XCoordinate=branch_4, YCoordinate=branch_6, ZCoordinate=0)
bar_graph_4 = BarGraph(branch_6, BarColor=RGB(255, 0, 90))

# ---- group: Monte Carlo analysis (continued)
offset_path_numbering_3 = OffsetPathNumbering(existing_tree=data_6, tree=round.Floor)
data_7 = Data([offset_path_numbering_3, data_6])
flip = FlipMatrix(Data=data_7)
branch_7 = TreeBranch(Tree=simplify(flip), Path=currentobject, MaintainPaths=True)
item_4 = ListItem(List=branch_7, Index="0", Wrap=True)  # -> Item, Item1, Item2, Item3, Item4, Item5, Item6, Item7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

# ---- group: Quary objects by constrain
number_slider_2 = Slider(18, range=0..18)
item_5 = ListItem(Names=txt, Index=number_slider_2, Wrap=True)
branch_8 = TreeBranch(Tree=data_7, Path=number_slider_2, MaintainPaths=True)
number_of_attribute = Panel(item_5)
cull = CullPattern(List=branch_8, CullPattern=[False, False, True, True])
index = ItemIndex(List=branch_8, Item=cull)
panel_13 = Panel(index)
lng_4 = ListLength(List=index)
no_objects_2 = Panel(lng_4)

# ----
viewer = ParamViewer(data_7)

# ---- group: Setting the viewport / Length
num_2 = Number(item_4.Item)

# ---- group: Custom material, GLh/c / IM, Mat
num_3 = Number(item_4.Item3)

# ---- group: Creating pairs of width and height / B - Apex, h
num_4 = Number(item_4.Item8)

# ---- group: Creating pairs of width and height / C - Corner h
num_5 = Number(item_4.Item6)

# ---- group: Global geometric parameters / Height
num_6 = Number(item_4.Item1)

# ---- group: Global geometric parameters / Pitch
num_7 = Number(item_4.Item17)

# ---- group: Custom material, GLh/c / Frame, Mat
num_8 = Number(item_4.Item2)

# ---- group: Custom material, GLh/c / Bracing, Mat
num_9 = Number(item_4.Item13)

# ---- group: Creating pairs of width and height / C - Base, h
num_10 = Number(item_4.Item5)

# ---- group: Creating pairs of width and height / IM, h
num_11 = Number(item_4.Item15)

# ---- group: Creating pairs of width and height / B - Corner, h
num_12 = Number(item_4.Item7)

# ---- group: Global geometric parameters / Span
num_13 = Number(item_4.Item)

# ---- group: Global geometric parameters
rad_2 = Radians(Degrees=num_7)
num_14 = Number([num_6, num_13, rad_2])

# ---- group: Custom material, GLh/c
num_15 = Number([num_8, num_3, num_9])
tab_4_5_en_14080_2013 = Panel("0.65")
path_mapper = PathMapper(num_15, source="{x}", target="{0}")
create_material_database = Python3Script(G_GPa=tab_4_5_en_14080_2013, E_values_GPa=path_mapper, output_path=current_folder_file)  # -> out, output_path; inputs G_GPa: Double, E_values_GPa: list of Double, output_path: String
# ---------- create_material_database: Python ----------
import System
import Rhino
import Grasshopper
import rhinoscriptsyntax as rs
import uuid # Required for generating unique GUIDs for each material

class MyComponent(Grasshopper.Kernel.GH_ScriptInstance):
    def RunScript(self, G_GPa: float, E_values_GPa: list[float], output_path: str):
        """
        Creates a .struxml file with multiple custom materials.
        Each material is defined by a Young's modulus (E) from the input list
        and a shared Shear modulus (G).

        Args:
            G_GPa:          Single value for Shear Modulus (Gmean) in [GPa].
            E_values_GPa:   A list of Young's Modulus (E0mean) values in [GPa].
            output_path:    Path to write the .struxml file.
        """

        # --- Input Conversion ---
        # Convert .NET List[float] to a Python list of floats
        # It's assumed E_values_GPa will always be provided and contain items.
        e_moduli_gpa_python = list(E_values_GPa)

        # --- Material Generation ---
        materials_xml_parts = [] # To store XML string for each material

        # Convert G from GPa to MPa (FEM-Design typically uses MPa for these direct inputs)
        # This is done once as G is the same for all materials.
        g_modulus_mpa = G_GPa * 1E3

        # Define consistent timestamps for 'last_change'
        last_change_timestamp = "2021-01-07T13:38:43.000"

        for e_gpa in e_moduli_gpa_python:
            # Generate a unique GUID for each material
            material_guid = str(uuid.uuid4())

            # Define material name based on its E value, formatted to two decimal places.
            material_name = f'E{e_gpa:.1f}' # Example: E28.50

            # Convert current E value from GPa to MPa
            e_modulus_mpa = e_gpa * 1E3

            # Conditional logic to select material structure based on E value
            if e_gpa == 210.0:
                # Use the provided steel material structure for E = 210 GPa
                material_xml = f'''
        <material guid="{material_guid}" last_change="{last_change_timestamp}" action="added" standard="EC" country="DK" name="{material_name}">
            <steel mass="7.85" E_0="0" E_1="0" E_2="0" nu_0="0" nu_1="0" nu_2="0" alfa_0="0" alfa_1="0" alfa_2="0" G_0="0" G_1="0" G_2="0" Fyk16="235" Fyk40="225" Fyk63="215" Fyk80="215" Fyk100="215" Fyk150="195" Fyk200="185" Fyk250="175" Fyk400="175" Fuk3="360" Fuk40="360" Fuk100="360" Fuk150="350" Fuk250="340" Fuk400="340" gammaM0_0="1" gammaM0_1="1" gammaM1_0="1" gammaM1_1="1" gammaM2_0="1.25" gammaM2_1="1.25" gammaM5_0="1" gammaM5_1="1" Ek="{e_modulus_mpa:.6f}" Ed_0="0" Ed_1="0" nu="0.3" G="80769" alfa="0.000012">
                <plastic_analysis_data elasto_plastic_behaviour_U="false" elasto_plastic_strain_limit_U="true" elasto_plastic_strain_limit_option_U="2.5" elasto_plastic_behaviour_Sq="false" elasto_plastic_strain_limit_Sq="true" elasto_plastic_strain_limit_option_Sq="2.5" elasto_plastic_behaviour_Sf="false" elasto_plastic_strain_limit_Sf="true" elasto_plastic_strain_limit_option_Sf="2.5" elasto_plastic_behaviour_Sc="false" elasto_plastic_strain_limit_Sc="true" elasto_plastic_strain_limit_option_Sc="2.5"></plastic_analysis_data>
            </steel>
        </material>'''
            else:
                # Keep the existing timber material structure for other E values
                material_xml = f'''
        <material guid="{material_guid}" last_change="{last_change_timestamp}" action="added" standard="EC" country="DK" name="{material_name}">
            <timber mass="0" E_0="0" E_1="0" E_2="0" nu_0="0" nu_1="0" nu_2="0" alfa_0="0.001" alfa_1="0.001" alfa_2="0.001"
                     G_0="0" G_1="0" G_2="0" type="0" quality="0"
                     Fmk0="14" Fmk90="14" Ft0k="7.2" Ft90k="0.4" Fc0k="16" Fc90k="2" Fvk="3"
                     E0mean="{e_modulus_mpa:.6f}" E90mean="230" E0comp="{e_modulus_mpa:.6f}" E90comp="230" 
                     Gmean="{g_modulus_mpa:.6f}" E005="4700" G005="294" Rhok="290" Rhomean="350"
                     gammaM_0="1.35" gammaM_1="1" ksys="1" k_cr="1" service_class="0"
                     kdefU="0" kdefSq="0.6" kdefSf="0.6" kdefSc="0.6" gammaMfi="1">
            </timber>
        </material>'''
            # Adding part
            materials_xml_parts.append(material_xml)

        # Join all material XML parts into a single string
        materials_xml_content = "\n".join(materials_xml_parts)

        # --- Main StruXML Structure ---
        # This is the overall template for the .struxml file.
        # The generated materials_xml_content will be inserted into the <materials> tag.
        # The database GUID can remain static.
        database_guid = "5bd0e6af-1baf-4f73-8369-015724045a94"
        
        struxml_content = f'''<?xml version="1.0" encoding="UTF-8"?>
<database struxml_version="01.00.000" source_software="FEM-Design 23.00.006" start_time="1970-01-01T00:00:00.000" end_time="2022-04-25T11:57:24.000" guid="{database_guid}" convertid="00000000-0000-0000-0000-000000000000" standard="EC" country="DK" xmlns="urn:strusoft">
    <materials>{materials_xml_content}
    </materials>
    <end></end>
</database>'''

        # --- File Writing ---
        with open(output_path, 'w', encoding='utf-8') as f:
            f.write(struxml_content)
        # Optionally, provide feedback to Grasshopper output
        print(f"Successfully wrote .struxml file to: {output_path}")

        # Return the path to the generated file
        return output_path
# ---------- end create_material_database ----------
extract_material_s = Python3Script(path=create_material_database.output_path)  # -> out, material; inputs path: String, name: String
# ---------- extract_material_s: Python ----------
import System
import Rhino
import Grasshopper

import rhinoscriptsyntax as rs

import FemDesign

class MyComponent(Grasshopper.Kernel.GH_ScriptInstance):
    def RunScript(self, path: str, name: str):
        """
        Deserializes a .struxml file and returns a list of materials.
        If a 'name' is provided, it returns a list containing only the material
        with that name (if found). Otherwise, it returns all materials in the database.

        Args:
            path: Path to the .struxml file.
            name: Optional. Name of the material to filter by.
                  If empty or None, all materials will be returned.
        Returns:
            A list of FemDesign.Materials.Material objects.
        """

        # Material database
        MD = FemDesign.Materials.MaterialDatabase.DeserializeStruxml(path)

        # Checking object functions
        # print(dir(MD.Materials))

        # Source files and documentation
        # Core: https://github.com/strusoft/femdesign-api/blob/19f2a93505b7a54293e57934e64f03d87de3a1a0/FemDesign.Core/Materials/MaterialDatabase.cs#L107
        # GH Comp.: https://github.com/strusoft/femdesign-api/blob/19f2a93505b7a54293e57934e64f03d87de3a1a0/FemDesign.Grasshopper/Materials/MaterialDatabase.cs
        
        # Number material in database
        N = MD.Materials.Material.get_Count()

        # Check if a material name is provided for filtering
        if name and name.strip(): # Check if 'name' is not None and not just whitespace
            # Attempt to find the material by the provided name
            filtered_material = MD.MaterialByName(name)
            if filtered_material:
                # If found, return a list containing only this material
                return [filtered_material]
            else:
                # If name is provided but material not found, return an empty list
                print(f"Material with name '{name}' not found in the database.")
                return []
        else:

            # Convert to normal Python list
            # p_list = [str(item) for item in MD.MaterialNames()]
            # print(python_list)

            # If no name is provided (or it's empty/whitespace), return all materials
            # MD.Materials.Material is already a .NET List<Material>, which Grasshopper
            # can directly handle as a list of material objects.
            return MD.Materials.Material
# ---------- end extract_material_s ----------

# ---- group: Creating pairs of width and height / Bracing, A
num_16 = Number(item_4.Item14)

# ---- group: Creating pairs of width and height / Width
num_17 = Number(expr("x*1E-3", item_4.Item4))

# ---- group: Creating pairs of width and height
expression_2 = Expression(h=[num_12, num_4, num_10, num_5, num_11], Expression="h*1E-3")  # -> simplify(graft(R))
expression_3 = Expression(A=num_16, Expression="sqrt(A)*1E-3")
lng_5 = ListLength(List=flatten(expression_2))
dup_2 = DuplicateData(Data=num_17, Number=lng_5, Order=True)  # -> simplify(graft(Data))
dup_3 = DuplicateData(Data=expression_3, Number="2", Order=True)
offset_path_numbering_4 = OffsetPathNumbering(existing_tree=dup_2, tree=dup_3)
num_18 = Number([expression_2, dup_2])
num_19 = Number([num_18, offset_path_numbering_4])

# ---- group: Arbitrary section
item_6 = ListItem(List=num_19, Index=0, Wrap=True)  # -> Item, Item1
panel_14 = Panel("""0,0,0
{1},0,0
{1},{0},0
0,{0},0""")
eval_7 = Evaluate(E="Format(\"{0:0}x{1:0}\", b*1E3, h*1E3)", h=item_6.Item, b=item_6.Item1)
format = Format(Format=panel_14, Culture=127, Data0=item_6.Item, Data1=item_6.Item1)
list_2 = ValueList({"SteelRolled", "SteelColdWorked", "SteelWelded", "Concrete", "Timber", "Unknown", "Undefined"}, selected="Timber")
item_7 = ListItem(List=format, Index="0", Wrap=True)  # -> Item, Item1, Item2, Item3
srf4pt = _4PointSurface(CornerA=item_7.Item, CornerB=item_7.Item1, CornerC=item_7.Item2, CornerD=item_7.Item3)
define = SectionDefine(Surfaces=srf4pt, MaterialType=list_2, GroupName="T", TypeName="T", SizeName=eval_7)  # -> flatten(CustomSection)

# ---- group: Stiff. index to rot. stiff. / B - Apex, SI
num_20 = Number(item_4.Item11)

# ---- group: Stiff. index to rot. stiff. / IM - Base, SI
num_21 = Number(item_4.Item12)

# ---- group: Stiff. index to rot. stiff. / Corner, SI
num_22 = Number(item_4.Item10)

# ---- group: Stiff. index to rot. stiff. / C - Base, SI
num_23 = Number(item_4.Item9)

# ---- group: Stiff. index to rot. stiff.
cc = Panel("""3
1
2
4""")
branch_9 = TreeBranch(Tree=num_19, Path=cc, MaintainPaths=False)
mat = Panel("""0
0
0
1""")
item_8 = ListItem(List=branch_9, Index=0, Wrap=True)  # -> Item, Item1
item_9 = ListItem(List=extract_material_s.material, Index=mat, Wrap=True)
improved_material_deconstruc = Python3Script(Material=item_9)  # -> E0mean, Gmean
# ---------- improved_material_deconstruc: Python ----------
import System
import Rhino
import Grasshopper

import rhinoscriptsyntax as rs

class MyComponent(Grasshopper.Kernel.GH_ScriptInstance):
    def RunScript(self, Material):
        
        # Extracting timber proporties
        T = Material.Timber

        return T.E0mean, T.Gmean
# ---------- end improved_material_deconstruc ----------
length_3 = Panel("""0
1
0
0""")
expression_4 = Expression(h=item_8.Item, b=item_8.Item1, Expression="1/12*b*h^3")  # -> flatten(R)
item_10 = ListItem(List=num_14, Index=length_3, Wrap=True)
num_24 = Number([num_22, num_20, num_23, num_21])
expression_5 = Expression(L=item_10, E0=improved_material_deconstruc.E0mean, Iy=expression_4, C=num_24, Expression="E0*Iy*C/L")
mnm_to_knm = Panel("1E3")
multiplication_2 = Multiplication(A=expression_5, B=mnm_to_knm)  # -> flatten(Result)

# ----
split_6 = SplitList(List=multiplication_2, Index="2")  # -> ListA, graft(ListB)

# ---- group: End conditions of beams
panel_15 = Panel("""True
True""")
bool = Boolean(panel_15)
construct_3 = ConnectivityConstruct(T_x=bool, T_y=bool, T_z=bool, R_x=bool, R_y=split_6.ListA, R_z=bool)
rigid_2 = ConnectivityRigid()
rev = ReverseList(List=construct_3)
replace = ReplaceItems(List=rev, Item=rigid_2, Indices="0", Wrap=False)
entwine_3 = Entwine(Branch00=construct_3, Branch01=replace, FlattenInputs=True)  # -> simplify(Result)

# ---- group: Beam lines
data_8 = Data(Tree({0}: ["{0,0,h}", "{L/2,0,h+L/2*tan(a)}"], {1}: ["{L/2,0,h+L/2*tan(a)}", "{L,0,h}"]))
panel_16 = Panel(data_8)
item_11 = ListItem(List=num_14, Index=0, Wrap=True)  # -> Item, Item1, Item2
eval_8 = Evaluate(E=panel_16, h=item_11.Item, L=item_11.Item1, a=item_11.Item2)
item_12 = ListItem(List=eval_8, Index=0, Wrap=True)  # -> Item, Item1
ln = Line(StartPoint=item_12.Item, EndPoint=item_12.Item1)

# ---- group: Intermediate columns / IM, Number
num_25 = Number(item_4.Item18)

# ---- group: Intermediate columns / IM, spacing
num_26 = Number(item_4.Item16)

# ---- group: Intermediate columns
equals_2 = Equality(FirstNumber="0", SecondNumber=num_25)  # -> Equality, Inequality
series = Series(Start="1", Step="1", Count=num_25)
item_13 = ListItem(List=num_14, Index=0, Wrap=True)  # -> Item, Item1, Item2
filter = StreamFilter(Gate=equals_2.Inequality, Stream0=num_25, Stream1=series)
expression_6 = Expression(L=item_13.Item1, Expression="{L/2,0,0}")
multiplication_3 = Multiplication(A=num_26, B=filter)
eval_9 = Evaluate(E="If(x=0,Null,{x,0,0})", x=multiplication_3)
eval_10 = Evaluate(E="If(x=0,Null,{x,0,h+x*tan(a)})", h=item_13.Item, x=multiplication_3, a=item_13.Item2)
yz = YZPlane(Origin=expression_6)
ln_2 = Line(StartPoint=eval_9, EndPoint=eval_10)
mirror = Mirror(Geometry=ln_2, Plane=yz)  # -> Geometry, Transform
line = Line([ln_2, mirror.Geometry])

# ----
split_7 = SplitList(List=define, Index="2")  # -> simplify(graft(ListA)), ListB
rev_2 = ReverseList(List=flatten(split_7.ListA))  # -> simplify(graft(List))
item_14 = ListItem(List=extract_material_s.material, Index=0, Wrap=True)  # -> Item, Item1, Item2

# ---- group: Column lines
data_9 = Data(Tree({0}: ["{0,0,0}", "{0,0,h}"], {1}: ["{L,0,0}", "{L,0,h}"]))
item_15 = ListItem(List=num_14, Index=0, Wrap=True)  # -> Item, Item1
panel_17 = Panel(data_9)
eval_11 = Evaluate(E=panel_17, h=item_15.Item, L=item_15.Item1)
item_16 = ListItem(List=eval_11, Index=0, Wrap=True)  # -> Item, Item1
ln_3 = Line(StartPoint=item_16.Item, EndPoint=item_16.Item1)  # -> flatten(Line)

# ----
beam = BarsTaperedBeam(Curve=ln, Material=item_14.Item, Section=[split_7.ListA, rev_2], Connectivity=entwine_3, OrientLCS=True, Identifier="B")  # -> flatten(Bar)
data_10 = Data(beam)
split_8 = SplitList(List=split_7.ListB, Index="2")  # -> ListA, ListB
item_17 = ListItem(List=extract_material_s.material, Index=0, Wrap=True)  # -> Item, Item1, Item2
column = BarsTaperedColumn(Line=ln_3, Material=item_17.Item, Section=split_8.ListA, OrientLCS=True, Identifier="C")  # -> flatten(Bar)
entwine_4 = Entwine(Branch00=flatten(ln_3), Branch01=line, FlattenInputs=True)  # -> simplify(Result)
split_9 = SplitList(List=split_8.ListB, Index="1")  # -> ListA, ListB
item_18 = ListItem(List=extract_material_s.material, Index=0, Wrap=True)  # -> Item, Item1, Item2
data_11 = Data([data_10, column])

# ---- group: Wind loading
item_19 = ListItem(List=num_14, Index=0, Wrap=True)  # -> Item, Item1, Item2
panel_18 = Panel("""0.0
0.2
0.7""")
panel_19 = Panel("""0.0
0.2
0.7""")
panel_20 = Panel("""0.0
0.2
0.4""")
panel_21 = Panel("""-0.6
-0.4
-0.4""")
panel_22 = Panel("""-0.6
-1.0
-0.5""")
panel_23 = Panel("""0
{0}/10
If({0}>L/2,L/4,{0}/2)
L/2
(L/2+{0}/10)
L""")
format_2 = Format(Format=panel_23, Culture=127, Data0="h*2")
division_3 = Division(A=item_19.Item, B=item_19.Item1)
deg = Degrees(Radians=item_19.Item2)
entwine_5 = Entwine(Branch00=panel_18, Branch01=panel_19, Branch02=panel_20, Branch03=panel_21, Branch04=panel_22, FlattenInputs=True)
format_3 = Format(Format="{{{0}, 0, If({0}<L/2, h+{0}*tan(a), h+(L-{0})*tan(a))}}", Culture=127, Data0=format_2)
eval_12 = Evaluate(E=format_3, h=item_19.Item, L=item_19.Item1, a=item_19.Item2)
panel_24 = Panel(division_3)
ranges = Panel("""5
15
30""")
split_10 = SplitList(List=ln_3, Index="1")  # -> ListA, ListB
linear_interpolate_between_points = LinearInterpolateBetweenPoints(values=entwine_5, ranges=ranges, X=deg)  # -> flatten(res)
D = Panel("""0.8
0.7""")
E = Panel("""-0.5
-0.3""")
pline = PolyLine(Vertices=eval_12, Closed=False)
smaller = SmallerThan(FirstNumber=deg, SecondNumber="5")  # -> SmallerThan, OrEqualTo
flip_2 = FlipCurve(Curve=split_10.ListB)  # -> Curve, Flag
flat_a_5 = Panel("""-1.8
-1.2
-0.7
-0.5""")
entwine_6 = Entwine(Branch00=D, Branch01=E, FlattenInputs=True)
explode = Explode(Curve=pline, Recursive=True)  # -> Segments, Vertices
ranges_2 = Panel("""1
0.25""")
line_2 = Line([split_10.ListA, flip_2.Curve])
filter_2 = StreamFilter(Gate=smaller.SmallerThan, Stream0=linear_interpolate_between_points, Stream1=flat_a_5)  # -> flatten(Stream)
line_3 = Line(explode.Segments)
linear_interpolate_between_points_2 = LinearInterpolateBetweenPoints(values=entwine_6, ranges=ranges_2, X=division_3)  # -> flatten(res)
ins = InsertItems(List=line_2, Item=line_3, Indices="1", Wrap=True)
filter_3 = StreamFilter(Gate=smaller.SmallerThan, Stream0="0,1,1,2,3", Stream1="0,1,2,2,2")
f_or_g = Panel("1")
cull_i = CullIndex(List=filter_2, Indices=f_or_g, Wrap=True)
Y = UnitY(Factor=1)
eval_13 = EvaluateCurve(Curve=ins, Parameter=0.5)  # -> Point, Tangent, Angle
split_11 = TextSplit(Text=filter_3, Separators=",")
xprod = CrossProduct(VectorA=Y, VectorB=eval_13.Tangent, Unitize="True")  # -> Vector, Length
item_20 = ListItem(List=cull_i, Index=split_11, Wrap=True)
panel_25 = Panel("0.2")
vdis = VectorDisplay(Anchor=eval_13.Point, Vector=xprod.Vector)
ins_2 = InsertItems(List=linear_interpolate_between_points_2, Item=item_20, Indices="1", Wrap=True)
eval_14 = Evaluate(E="(c_pe - c_pi)*q_p*s", c_pe=ins_2, c_pi="-0.3", q_p="0.9", s="6")
multiplication_4 = Multiplication(A=xprod.Vector, B=eval_14)

# ----
column_2 = BarsColumn(Line=line, Material=item_18.Item1, Section=split_9.ListA, Connectivity=[rigid, hinged], OrientLCS=True, Identifier="C")  # -> flatten(Bar)

# ---- group: Bracing bars
lng_6 = ListLength(List=entwine_4)  # -> expr("x/2", Length)
panel_26 = Panel("""0
0""")
ins_3 = InsertItems(List=lng_6, Item=graft(panel_26), Indices="0", Wrap=True)
item_21 = ListItem(List=extract_material_s.material, Index=0, Wrap=True)  # -> Item, Item1, Item2
item_22 = ListItem(List=entwine_4, Index=ins_3, Wrap=True)
improved_material_deconstruc_2 = Python3Script(Material=item_21.Item2)  # -> E0mean, Gmean
# ---------- improved_material_deconstruc_2: Python ----------
import System
import Rhino
import Grasshopper

import rhinoscriptsyntax as rs

class MyComponent(Grasshopper.Kernel.GH_ScriptInstance):
    def RunScript(self, Material):
        
        # Material type
        Type = Material.Family.ToString()

        # Extracting material proporties depending on type
        if Type == 'Steel':
            print('S')
            S = Material.Steel
            E = S.Ek
            G = S.G

        elif Type == 'Timber':
            print('T')
            T = Material.Timber
            E = T.E0mean
            G = T.Gmean

        return E, G
# ---------- end improved_material_deconstruc_2 ----------
flip_3 = FlipMatrix(Data=item_22)
end = EndPoints(Curve=flip_3)  # -> reverse(Start), End
short = Panel("""0
2""")
equals_3 = Equality(FirstNumber="210*1E3", SecondNumber=improved_material_deconstruc_2.E0mean)  # -> Equality, Inequality
tension = Panel("""1
2""")
ln_4 = Line(StartPoint=end.Start, EndPoint=end.End)  # -> flatten(Line)
filter_4 = StreamFilter(Gate=equals_3.Equality, Stream0=short, Stream1=tension)
item_23 = ListItem(List=ln_4, Index=filter_4, Wrap=True)
hinged_2 = ConnectivityHinged()
Y_2 = UnitY(Factor=1)
line_4 = Line(item_23)
beam_2 = BarsBeam(
    Curve=line_4,
    Material=item_21.Item2,
    Section=split_9.ListB,
    Connectivity=hinged_2,
    LocalY=Y_2,
    OrientLCS=True,
    Identifier="B")  # -> flatten(Bar)

# ----
data_12 = Data([data_11, column_2])

# ---- group: Supports
end_2 = EndPoints(Curve=entwine_4)  # -> Start, End
construct_4 = MotionsConstruct(X_neg="1E14", X_pos="1E14", Y_neg="1E14", Y_pos="1E14", Z_neg="1E14", Z_pos="1E14")
lng_7 = ListLength(List=end_2.End)
dup_4 = DuplicateData(Data=split_6.ListB, Number=lng_7, Order=True)  # -> simplify(Data)
dup_5 = DuplicateData(Data=construct_4, Number=lng_7, Order=True)  # -> simplify(Data)
construct_5 = RotationsConstruct(X_neg="0", X_pos="0", Y_neg=dup_4, Y_pos=dup_4, Z_neg="0", Z_pos="0")
construct_6 = PointSupportConstruct(PointPlane=end_2.Start, Motions=dup_5, Rotations=construct_5, Identifier="S")  # -> flatten(PointSupport)

# ----
lineload_define = LineLoadDefine(Curve=ins, StartForce=multiplication_4, LoadCase=construct, ConstLoadDir=True, LoadProjection=False, Type="Force")

# ---- group: Removing Null element (when No. IM = 0)
data_13 = Data([data_12, construct_6, beam_2])
null = NullItem(Item=data_13)  # -> NullFlags, InvalidFlags, Description
cull_2 = CullPattern(List=data_13, CullPattern=invert(null.NullFlags))

# ----
construct_7 = ModelConstruct(CountryCode="S", StructureElements=cull_2, Loads=lineload_define, LoadCases=construct, LoadCombinations=construct_2)

# ---- group: Live view of model in FEM-Design
connection = FEMDesignConnection(Verbosity="ScriptLogLinesOnly", DeleteOutputFolder=False)  # disabled
toggle = BooleanToggle(True)  # disabled
panel_27 = Panel("SavedModels")  # disabled
panel_28 = Panel("TestIM.str")  # disabled
analysis_2 = AnalysisDefine(CalcCase=toggle, CalcComb=True, CalcGmax=False, CalcDesign=False, Elemfine=True, Diaphragm=0, PeakSmoothing=False)  # disabled
openmodel = FEMDesignOpenModel(Connection=connection, Model=construct_7, RunNode=True)  # -> Connection, Model, Log, Success; disabled
create_folder_and_return_path_2 = Python3Script(FileName=panel_28, FolderName=panel_27)  # -> out, path; inputs FileName: String, FolderName: String; disabled; same code as create_folder_and_return_path
resultstype_3 = ResultsType({"NodalDisplacement", "PointSupportReaction", "PointSupportReactionMinMax", "LineSupportReaction", "LineSupportResultant", "SurfaceSupportReaction", "SurfaceSupportResultant", "BarInternalForce", "BarDisplacement", "BarEndForce"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}, selected="BarDisplacement")  # disabled
resultstype_4 = ResultsType({"NodalDisplacement", "PointSupportReaction", "PointSupportReactionMinMax", "LineSupportReaction", "LineSupportResultant", "SurfaceSupportReaction", "SurfaceSupportResultant", "BarInternalForce", "BarDisplacement", "BarEndForce"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}, selected="BarInternalForce")  # disabled
panel_29 = Panel("Millimeters")  # disabled
save = FEMDesignSave(Connection=openmodel.Connection, FilePath=create_folder_and_return_path_2.path, RunNode=True)  # -> Connection, Success; disabled
panel_30 = Panel("mm")  # disabled
rep_2 = ReplaceText(Text=panel_29, Find=panel_29, Replace=panel_30, RecursiveReplace=False)  # disabled
runanalysis = FEMDesignRunAnalysis(Connection=save.Connection, Analysis=analysis_2, RunNode=True)  # -> Connection, Log, Success; disabled
units_2 = Units(Length=rep_2, Angle="rad", SectionalData="m", Force="kN", Mass="kg", Displacement="mm", Stress="Pa")  # disabled
merge_2 = Merge(Data1=resultstype_3, Data2=resultstype_4)  # disabled
casecombresults = FEMDesignGetCaseCombResults(Connection=runanalysis.Connection, ResultType=merge_2, Units=units_2, RunNode=True)  # -> Connection, Results, Success; disabled
bang_3 = ExplodeTree(Data=casecombresults.Results)  # -> Branch0, Branch1; disabled
getfemodel = FEMDesignGetFeModel(Connection=casecombresults.Connection, Units=units_2, RunNode=True)  # -> Connection, FiniteElement, Success; disabled

# ----
runapplication = ApplicationRun(
    Model=construct_7,
    Analysis=analysis,
    ResultTypes=merge,
    Units=units,
    GlobalConfig=change_no_element_division.path,
    SaveFilePath=create_folder_and_return_path.path,
    RunNode=Toggle(True),
    keepOpen=False,
    minimised=True)  # -> Model, FiniteElement, Results
bang_4 = ExplodeTree(Data=runapplication.Results)  # -> Branch0, Branch1

# ---- group: Element outlines and notation / Rotational stiffness / IM, Number
num_27 = Number(expr("x*2", item_4.Item18))

# ---- group: Element outlines and notation / Rotational stiffness / Stiff. indices
num_28 = Number(num_24)

# ---- group: Setting the viewport
margin_type = ValueList({"Dynamic": 0, "Constant": 1}, selected="Dynamic")
expression_7 = Expression(x=num_2, Expression="x/2")
z_trans = Slider(-4, range=-4..4)
perc_m = Slider(1.21, range=1..1.5)
const_m = Slider(0.21, range=0.1..1.1)
item_24 = ListItem(List=dedomain_2.End, Index="0", Wrap=True)
X = UnitX(Factor=expression_7)
addition = Addition(A=X, B="0,0,0")
custom_viewport = Panel("GH_Print")
Z = UnitZ(Factor=z_trans)
multiplication_5 = Multiplication(A=num_2, B=perc_m)
subtraction = Subtraction(A=addition, B=Z)
xz = XZPlane(Origin=subtraction)

# ---- group: Setting the viewport / Maximum length
num_29 = Number(item_24)

# ---- group: Setting the viewport (continued)
addition_2 = Addition(A=const_m, B=num_29)
filter_5 = StreamFilter(Gate=margin_type, Stream0=multiplication_5, Stream1=addition_2)
view = ModelView(Perspective=Toggle(False), Location=xz, XExtents=filter_5, YExtents=filter_5)  # -> View, Title, Perspective, Location, Target, XExtents, YExtents
model_viewport = ModelViewport(Viewport=custom_viewport, View=view.View, DisplayMode=custom_viewport)  # -> Viewport, Name, View, DisplayMode
viewport = ModelViewport(model_viewport.Viewport)
cache = ContentCache(Name="T", Content=viewport, Action=Toggle(True))  # -> Name, Content, Result

# ---- group: Parametric analysis
# https://tt-acm.github.io/DesignExplorer/
panel_31 = Panel("0")
sub_domain = ColibriIterationSubdomain(Divisions=panel_31)
colibri_in = ColibriInputsIterator(S=sub_domain, CurrentObject=currentobject, ignoreAllWarningMsg=True)  # -> U, IP, CurrentObject, V_N
resolution = Slider(2100, range=400..2100)
set_img = ColibriImageSetting(ImageSaveAsName="defaultName", RhinoViewNames=custom_viewport, Width=resolution, Height=resolution)
create_folder_s = Python3Script(FolderName="Colibri\Frame4")  # -> out, path; inputs FolderName: String
# ---------- create_folder_s: Python ----------
"""Grasshopper Script Instance"""
import System
import Rhino
import Grasshopper

import rhinoscriptsyntax as rs
import os

class MyComponent(Grasshopper.Kernel.GH_ScriptInstance):
    def RunScript(self, FolderName: str):

        # Get the current document path
        folder = rs.DocumentPath() 

        # Define the full path by joining with user-specified FolderName
        # Normalize FolderName to handle both '/' and '\\'
        normalized_subpath = os.path.normpath(FolderName)

        # Combine the base folder with the normalized subpath
        save_folder = os.path.join(folder, normalized_subpath)

        # Create all intermediate folders if they don't exist
        if not os.path.exists(save_folder):
            os.makedirs(save_folder)
            print(f"Created missing folders up to: {save_folder}")

        # Return the path to the innermost folder
        return save_folder
# ---------- end create_folder_s ----------

# ---- group: Deformed shape
fembar = FiniteElementFemBar(FiniteElement=runapplication.FiniteElement)  # -> Identifier, ElementId, NodeI, NodeJ, LineGeometry
bardisplacement = BarDisplacement(Result=bang_4.Branch0, CaseCombinationName=disp_loadcase)  # -> CaseIdentifier, ElementId, PositionResult, Translation, Rotation
panel_32 = Panel("0")

# ---- group: Deformed shape / Removing duplicate lines
join = JoinCurves(Curves=fembar.LineGeometry, Preserve=False)  # -> simplify(Curves)
midpt = CurveMiddle(Curve=join)  # -> flatten(Midpoint)
cullpt = CullDuplicates(Points=midpt, Tolerance=0.1, CullMode=1)  # -> Points, Indices, Valence
item_25 = ListItem(List=flatten(join), Index=cullpt.Indices, Wrap=True)  # -> simplify(graft(Item))

# ---- group: Deformed shape / Extracting disp. and removing dup.
extra_split_domain = ExtraSplitDomain(P=bardisplacement.PositionResult, T=bardisplacement.Translation, B=panel_32)  # -> P_2, T_2
scale = Slider(100, range=1..700)
remove_dup_values = RemoveDupValues(values=extra_split_domain.P_2)  # -> X_2, I
item_26 = ListItem(List=extra_split_domain.T_2, Index=remove_dup_values.I, Wrap=True)
multiplication_6 = Multiplication(A=item_26, B=scale)

# ---- group: Deformed shape (continued)
eval_15 = EvaluateLength(Curve=item_25, Length=remove_dup_values.X_2, Normalized=False)  # -> Point, Tangent, Parameter

# ---- group: Moving undeformed points by their translation
Y_3 = UnitY(Factor=1)
pl = ConstructPlane(Origin=eval_15.Point, XAxis=eval_15.Tangent, YAxis=Y_3)  # -> simplify(Plane)
xy = XYPlane(Origin=Point(0, 0, 0))
orient = Orient(Geometry=multiplication_6, Source=xy, Target=pl)  # -> Geometry, Transform

# ---- group: Deformed shape / Scale notation
md_slider = MDSlider(
    SliderMode=0,
    slider_value=Point(0.6012142684, 0.1420001984, 0.5),
    x_domain=Domain(0, 2),
    y_domain=Domain(-1, 0),
    z_domain=Domain(0, 1))
xy_2 = XYPlane(Origin=Point(0, 0, 0))
xz_2 = XZPlane(Origin=Point(0, 0, 0))
concat_3 = Concatenate(FragmentA="Scale: ", FragmentB=scale)
orient_2 = Orient(Geometry=md_slider, Source=xy_2, Target=xz_2)  # -> Geometry, Transform
pt_2 = Point("{0,0,0}")
det_size = Slider(0.21, range=0..0.4)
move = Move(Geometry=pt_2, Motion=orient_2.Geometry)  # -> Geometry, Transform
xz_3 = XZPlane(Origin=move.Geometry)
tag = TextTag3D(Location=xz_3, Text=concat_3, Size=det_size, Justification=1)

# ---- group: Internal forces / Offsetting geometry
c_units = ConvertUnits(Data=eval_15.Point, Source=panel_7, Target=1)
pdecon = Deconstruct(Point=c_units)  # -> XComponent, YComponent, ZComponent
bnd_4 = Bounds(Numbers=flatten(pdecon.XComponent))
offset = Slider(9, range=0..14)
dedomain_6 = DeconstructDomain(Domain=bnd_4)  # -> Start, End
addition_3 = Addition(A=dedomain_6.End, B=offset)
series_2 = Series(Start=addition_3, Step=addition_3, Count=Slider(3, range=1..4))  # -> simplify(graft(Series))
X_2 = UnitX(Factor=series_2)
bang_5 = ExplodeTree(Data=X_2)  # -> Branch0, Branch1, Branch2

# ---- group: Displaying deformed shape and
expression_8 = Expression(i=eval_15.Point, f=orient.Geometry, Expression="f-i")
c_units_2 = ConvertUnits(Data=orient.Geometry, Source=panel_7, Target=1)
pdecon_2 = Deconstruct(Point=expression_8)  # -> XComponent, YComponent, ZComponent
pline_2 = PolyLine(Vertices=c_units_2, Closed=False)
bnd_5 = Bounds(Numbers=flatten(pdecon_2.XComponent))
lng_8 = ListLength(List=pdecon_2.XComponent)
dedomain_7 = DeconstructDomain(Domain=bnd_5)  # -> Start, End
dom = ConstructDomain(DomainStart=0, DomainEnd=lng_8)
gradient = Gradient(
    LowerLimit=dedomain_7.Start,
    UpperLimit=dedomain_7.End,
    Parameter=pdecon_2.XComponent,
    stops=[0: RGB(0, 0, 255), 0.333: RGB(5, 138, 95), 0.667: RGB(163, 89, 58), 1: RGB(193, 23, 10)])
range = Range(Domain=dom, Steps=expr("x+1", lng_8))
shatter = Shatter(Curve=pline_2, Parameters=range)
curve_preview = CustomCurvePreview(Curve=shatter, Linetype=linetype_3, Colour=gradient)

# ---- group: Internal forces
barinternalforce = BarInternalForce(Result=bang_4.Branch1, CaseCombinationName=disp_loadcase)  # -> CaseIdentifier, ElementId, PositionResult, Fx, Fy, Fz, Mx, My, Mz
item_27 = ListItem(List=barinternalforce.My, Index=remove_dup_values.I, Wrap=True)
c_units_3 = ConvertUnits(Data=item_27, Source=panel_7, Target=1)
addition_4 = Addition(A=bang_5.Branch0, B=c_units)
item_28 = ListItem(List=barinternalforce.Fz, Index=remove_dup_values.I, Wrap=True)
addition_5 = Addition(A=bang_5.Branch1, B=c_units)
addition_6 = Addition(A=bang_5.Branch2, B=c_units)
item_29 = ListItem(List=barinternalforce.Fx, Index=remove_dup_values.I, Wrap=True)

# ---- group: Extracting result
item_30 = TreeItem(Tree=simplify(pdecon_2.XComponent), Path="0", Index="0", Wrap=True)
division_4 = Division(A=item_30, B=scale)
hori_disp_left_corner = Panel(division_4)

# ---- group: Noting maximum displacement
dedomain_8 = DeconstructDomain(Domain=bnd_5)  # -> Start, End
expression_9 = Expression(i=dedomain_8.Start, a=dedomain_8.End, Expression="max(abs(i),a)")
abs = Absolute(Value=pdecon_2.XComponent)
width = Slider(4.2, range=0..7)
height_2 = Slider(0.56, range=-1.4..1.4)
fsim = FindSimilarMember(Data=expression_9, Set=flatten(abs))  # -> Hit, Index
division_5 = Division(A=fsim.Hit, B=scale)
item_31 = ListItem(List=flatten(c_units_2), Index=fsim.Index, Wrap=True)
X_3 = UnitX(Factor=expr("abs(x)", [height_2, width]))
Z_2 = UnitZ(Factor=height_2)
format_4 = Format(Format="{0:0.00} mm", Culture=127, Data0=division_5)
move_2 = Move(Geometry=item_31, Motion=X_3)  # -> Geometry, Transform
z_offset = Slider(0.1, range=0..0.4)
move_3 = Move(Geometry=move_2.Geometry, Motion=expr("-x", Z_2))  # -> Geometry, Transform
concat_4 = Concatenate(FragmentA="Maximum: ", FragmentB=format_4)
Z_3 = UnitZ(Factor=z_offset)
item_32 = ListItem(List=move_3.Geometry, Index="-1", Wrap=True)
pt_3 = Point([item_31, move_3.Geometry])
pline_3 = PolyLine(Vertices=pt_3, Closed=False)
move_4 = Move(Geometry=item_32, Motion=Z_3)  # -> Geometry, Transform
xz_4 = XZPlane(Origin=move_4.Geometry)
tag_2 = TextTag3D(Location=xz_4, Text=concat_4, Size=det_size, Justification=9)

# ---- group: Parametric analysis (continued)
colibri_out = ColibriOutputs(
    Span=flatten(item_4.Item),
    Height=flatten(item_4.Item1),
    Material_frame=flatten(item_4.Item2),
    Material_interm=flatten(item_4.Item3),
    Width=flatten(item_4.Item4),
    Height_column_base=flatten(item_4.Item5),
    Height_column_corner=flatten(item_4.Item6),
    Height_beam_corner=flatten(item_4.Item7),
    Height_beam_apex=flatten(item_4.Item8),
    SI_column_base=flatten(item_4.Item9),
    SI_corner=flatten(item_4.Item10),
    SI_beam_apex=flatten(item_4.Item11),
    SI_interm_base=flatten(item_4.Item12),
    Material_bracing=flatten(item_4.Item13),
    Area_bracing=flatten(item_4.Item14),
    Height_interm=flatten(item_4.Item15),
    Spacing_interm=flatten(item_4.Item16),
    Pitch=flatten(item_4.Item17),
    No_interm=flatten(item_4.Item18),
    Corner_deflection=flatten(division_4),
    Max_deflection=flatten(division_5))
ca = ColibriAggregator(
    Folder=create_folder_s.path,
    Inputs=colibri_in.IP,
    Outputs=colibri_out,
    ImageSetting=set_img,
    Write=Toggle(False),
    recordingMode=0)

# ---- group: Internal forces / Cluster for plotting
z = Slider(-2, range=-2..7)
S = Slider(0.06, range=0..1)
disp_forces = DispForces(local_x=eval_15.Tangent, magnitude=c_units_3, scale=S, s_point=addition_4, z_offset=z, lines=entwine)
S_2 = Slider(0.26, range=0..1)
z_2 = Slider(-1.5, range=-2..7)
disp_forces_2 = DispForces(local_x=eval_15.Tangent, magnitude=item_28, scale=S_2, s_point=addition_5, z_offset=z_2, lines=entwine)
z_3 = Slider(-1.6, range=-2..7)
S_3 = Slider(0.03, range=0..1)
disp_forces_3 = DispForces(local_x=eval_15.Tangent, magnitude=item_29, scale=S_3, s_point=addition_6, z_offset=z_3, lines=entwine)

# ---- group: Element outlines and notation
deconstruct = ModelDeconstruct(Model=runapplication.Model)  # -> CountryCode, Foundations, graft(Bars), Shells, LabelledSection, Panels, Loads, LoadCases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
deconstruct_modify = BarDeconstructModify(Bar=deconstruct.Bars)  # -> Bar, Guid, Curve, Material, Section, Connectivity, Eccentricity, LocalY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
deconstruct_2 = SectionDeconstruct(Section=deconstruct_modify.Section)  # -> Guid, Name, simplify(Surfaces), SectionType, MaterialType, GroupName, TypeName, simplify(graft(SizeName))
ensure_2_levels = Ensure2Levels(T=deconstruct_2.SizeName)
not_size = Slider(0.21, range=0..0.5)

# ---- group: Element outlines and notation / Orientation of section at beam ends
explode_2 = Explode(Curve=deconstruct_modify.Curve, Recursive=True)  # -> Segments, simplify(Vertices)
xprod_2 = CrossProduct(VectorA=deconstruct_modify.Curve, VectorB=deconstruct_modify.LocalY, Unitize=deconstruct_modify.LocalY)  # -> Vector, Length
pl_2 = ConstructPlane(Origin=explode_2.Vertices, XAxis=deconstruct_modify.LocalY, YAxis=xprod_2.Vector)  # -> graft(Plane)

# ---- group: Element outlines and notation / Adjust column and bars
split_12 = SplitTree(Data=ensure_2_levels, Masks=flatten("{<4;?}"))  # -> Positive, Negative
replace_2 = ReplaceItems(List=split_12.Negative, Indices=0, Wrap=False)  # -> simplify(List)
replace_3 = ReplaceItems(List=split_12.Positive, Indices=0, Wrap=False)  # -> simplify(List)
concat_5 = Concatenate(FragmentA=" - ", FragmentB=split_12.Negative)
data_14 = Data([split_12.Positive, replace_2])
data_15 = Data([replace_3, concat_5])
split_13 = SplitTree(Data=data_14, Masks="{?;0}")  # -> Positive, Negative
split_14 = SplitTree(Data=data_15, Masks="{?;0}")  # -> Positive, Negative
concat_6 = Concatenate(FragmentA=deconstruct_modify.Material, FragmentB=split_14.Positive)

# ---- group: Element outlines and notation / 3D Geometry
orient_3 = Orient(Geometry=deconstruct_2.Surfaces, Source=PlaneXY(0, 0, 0), Target=pl_2)  # -> Geometry, Transform
debrep = DeconstructBrep(Brep=orient_3.Geometry)  # -> Faces, Edges, simplify(Vertices)
pline_4 = PolyLine(Vertices=debrep.Vertices, Closed=True)
ensure_2_levels_2 = Ensure2Levels(T=debrep.Vertices)
relitem = RelativeItem(Tree=ensure_2_levels_2, Offset="{0;+1}", WrapPaths=False, WrapItems=False)  # -> ItemA, ItemB
ln_5 = Line(StartPoint=relitem.ItemA, EndPoint=relitem.ItemB)

# ---- group: Element outlines and notation / End planes
dynamic_offset = DynamicOffset(C=pline_4)
multiplication_7 = Multiplication(A=dynamic_offset, B=xprod_2.Vector)
move_5 = Move(Geometry=explode_2.Vertices, Motion=multiplication_7)  # -> Geometry, Transform
pl_3 = ConstructPlane(Origin=move_5.Geometry, XAxis=explode_2.Segments, YAxis=xprod_2.Vector)  # -> simplify(graft(Plane))
ensure_2_levels_3 = Ensure2Levels(T=pl_3)
split_15 = SplitTree(Data=ensure_2_levels_3, Masks="{?;0}")  # -> Positive, Negative

# ---- group: Element outlines and notation / Center planes
avr = Average(Input=dynamic_offset)
multiplication_8 = Multiplication(A=xprod_2.Vector, B=avr)
midpt_2 = CurveMiddle(Curve=explode_2.Segments)
move_6 = Move(Geometry=midpt_2, Motion=multiplication_8)  # -> Geometry, Transform
pl_4 = ConstructPlane(Origin=move_6.Geometry, XAxis=explode_2.Segments, YAxis=xprod_2.Vector)

# ---- group: Element outlines and notation / Rotational stiffness
series_3 = Series(Start="4", Step=1, Count=num_27)  # -> flatten(Series)
panel_33 = Panel("""2
3""")
end_3 = EndPoints(Curve=deconstruct_modify.Curve)  # -> Start, End
dup_6 = DuplicateData(Data="3", Number=num_27, Order=True)  # -> flatten(Data)
panel_34 = Panel("""2
2""")
panel_35 = Panel("""2
0
1""")
z_offset_2 = Slider(-0.42, range=-0.42..0)
int = Integer([panel_33, series_3])
item_33 = ListItem(List=flatten(end_3.End), Index=panel_35, Wrap=True)
item_34 = ListItem(List=flatten(end_3.Start), Index=int, Wrap=True)
item_35 = ListItem(List=num_28, Index=[panel_34, dup_6, panel_9], Wrap=True)
order = Panel("""Corner
B - Apex
C - Base
IM - Base""")
format_5 = Format(Format="{0:0.00}", Culture=127, Data0=item_35)
Z_4 = UnitZ(Factor=z_offset_2)
pt_4 = Point([item_34, item_33])
move_7 = Move(Geometry=pt_4, Motion=Z_4)  # -> Geometry, Transform
xz_5 = XZPlane(Origin=move_7.Geometry)
num_30 = Number(not_size)
tag_3 = TextTag3D(Location=xz_5, Text=format_5, Size=num_30, Justification=8)

# ---- group: Element outlines and notation (continued)
tag_4 = TextTag3D(Location=split_15.Positive, Text=split_13.Positive, Size=not_size, Justification=7)
tag_5 = TextTag3D(Location=split_15.Negative, Text=split_13.Negative, Size=not_size, Justification=9)
tag_6 = TextTag3D(Location=pl_4, Text=concat_6, Size=not_size, Justification=8)

# ==== cluster ExtraSplitDomain
P = ClusterInput()
T = ClusterInput()
B = ClusterInput()
equals = Equality(FirstNumber=P, SecondNumber=B)  # -> Equality, Inequality
lng = ListLength(List=P)
series = Series(Start=0, Step=1, Count=lng)
expression = Expression(x=lng, Expression="x-1")
cull = CullPattern(List=series, CullPattern=equals.Equality)
expression_2 = Expression(x=cull, Expression="x-1")
ins = InsertItems(List=expression_2, Item=expression, Indices="-1", Wrap=True)
cull_i = CullIndex(List=ins, Indices="0", Wrap=True)
dom = ConstructDomain(DomainStart=cull, DomainEnd=cull_i)
subset = SubList(List=P, Domain=dom, Wrap=True)  # -> simplify(List), Index
subset_2 = SubList(List=T, Domain=dom, Wrap=True)  # -> simplify(List), Index
T_2 = ClusterOutput(subset_2.List)
item = ListItem(List=subset.List, Index="-1", Wrap=True)
subtraction = Subtraction(A=item, B="0.001")
replace = ReplaceItems(List=subset.List, Item=subtraction, Indices="-1", Wrap=True)
P_2 = ClusterOutput(replace)

# ==== cluster DispForces
s_point = ClusterInput()
pdecon = Deconstruct(Point=flatten(s_point))  # -> XComponent, YComponent, ZComponent
bnd = Bounds(Numbers=pdecon.XComponent)  # -> flatten(Domain)
x_offset = Slider(0.65, range=0.1..1)
dedomain = DeconstructDomain(Domain=bnd)  # -> Start, End
z_offset = ClusterInput()
addition = Addition(A=dedomain.Start, B=x_offset)
Z = UnitZ(Factor=z_offset)  # -> simplify(graft(UnitVector))
spacing = Slider(0.24, range=0..1)
X = UnitX(Factor=addition)
no_legends = Slider(5, range=3..7)
addition_2 = Addition(A=X, B=Z)
Z_2 = UnitZ(Factor=spacing)
magnitude = ClusterInput()
pdecon_2 = Deconstruct(Point=addition_2)  # -> XComponent, YComponent, ZComponent
dcon = DeleteConsecutive(Set=magnitude, Wrap=False)  # -> Set, Count
series = Series(Start=pdecon_2.ZComponent, Step=Z_2, Count=no_legends)
local_x = ClusterInput()
pt = ConstructPoint(XCoordinate=pdecon_2.XComponent, YCoordinate=pdecon_2.YComponent, ZCoordinate=series)
scale = ClusterInput()
lines = ClusterInput()
xprod = CrossProduct(VectorA=local_x, VectorB="{0,-1,0}", Unitize=True)  # -> Vector, Length
multiplication = Multiplication(A=dcon.Set, B=scale)
offset = Slider(0.1, range=0..1)
bang = ExplodeTree(Data=simplify(lines))  # -> Branch0, Branch1, Branch2, Branch3, Branch4
item = ListItem(List=pt, Index=[0, -1], Wrap=True)
line_length = Slider(0.7, range=0..1)
multiplication_2 = Multiplication(A=xprod.Vector, B=multiplication)
X_2 = UnitX(Factor=offset)
bnd_2 = Bounds(Numbers=flatten(dcon.Set))
move = Move(Geometry=s_point, Motion=multiplication_2)  # -> Geometry, Transform
pline = PolyLine(Vertices=s_point, Closed=False)
lng = ListLength(List=dcon.Set)
move_2 = Move(Geometry=pt, Motion=X_2)  # -> Geometry, Transform
X_3 = UnitX(Factor=line_length)
curve_preview = CustomCurvePreview(Curve=pline, Linetype=bang.Branch3, Colour=RGB(0, 0, 0))
dom = ConstructDomain(DomainStart=0, DomainEnd=lng)
range = Range(Domain=bnd_2, Steps=expr("x-1", no_legends))  # -> simplify(Range)
ln = Line(StartPoint=s_point, EndPoint=move.Geometry)
move_3 = Move(Geometry=move_2.Geometry, Motion=X_3)  # -> Geometry, Transform
dedomain_2 = DeconstructDomain(Domain=bnd_2)  # -> Start, End
pline_2 = PolyLine(Vertices=move.Geometry, Closed=False)
range_2 = Range(Domain=dom, Steps=lng)
ln_2 = Line(StartPoint=move_2.Geometry, EndPoint=move_3.Geometry)
item_2 = ListItem(List=move_3.Geometry, Index=[0, -1], Wrap=True)
gradient = Gradient(
    LowerLimit=dedomain_2.Start,
    UpperLimit=dedomain_2.End,
    Parameter=dcon.Set,
    stops=[0: RGB(0, 0, 255), 0.333: RGB(5, 138, 95), 0.667: RGB(163, 89, 58), 1: RGB(193, 23, 10)])
gradient_2 = Gradient(
    LowerLimit=dedomain_2.Start,
    UpperLimit=dedomain_2.End,
    Parameter=range,
    stops=[0: RGB(0, 0, 255), 0.333: RGB(5, 138, 95), 0.667: RGB(163, 89, 58), 1: RGB(193, 23, 10)])
pt_2 = Point([item_2, item])
shatter = Shatter(Curve=pline_2, Parameters=range_2)
fcircle = CircleFit(Points=pt_2)  # -> Circle, Radius, Deviation
avr = Average(Input=pt_2)
Z_3 = UnitZ(Factor=1)
format = Format(Format="{0:0.0}", Culture=127, Data0=range)
alongcrv = SortAlongCurve(Points=pt_2, Curve=fcircle.Circle)  # -> Points, Indices
pl = ConstructPlane(Origin=avr, XAxis=Vector(1, 0, 0), YAxis=Z_3)
pline_3 = PolyLine(Vertices=alongcrv.Points, Closed=True)
curve_preview_2 = CustomCurvePreview(Curve=ln, Linetype=bang.Branch0, Colour=gradient)
curve_preview_3 = CustomCurvePreview(Curve=shatter, Linetype=bang.Branch0, Colour=gradient)
scale_nu = ScaleNU(Geometry=pline_3, Plane=pl, ScaleX=Slider(1.9, range=1..2), ScaleY=Slider(1.4, range=1..2), ScaleZ=1)  # -> Geometry, Transform
shift = Slider(0.288, range=0..1)
Z_4 = UnitZ(Factor=1)
X_4 = UnitX(Factor=expr("-x", shift))
pl_2 = ConstructPlane(Origin=pt, XAxis=Vector(1, 0, 0), YAxis=Z_4)
move_4 = Move(Geometry=scale_nu.Geometry, Motion=X_4)  # -> Geometry, Transform
tag = TextTag3D(Location=pl_2, Text=format, Size=0.14, Colour=gradient_2, Justification=6)
curve_preview_4 = CustomCurvePreview(Curve=ln_2, Linetype=bang.Branch2, Colour=gradient_2)
curve_preview_5 = CustomCurvePreview(Curve=move_4.Geometry, Linetype=bang.Branch1, Colour=bang.Branch4)

# ==== cluster RemoveDupValues
values = ClusterInput()
X = UnitX(Factor=values)
cullpt = CullDuplicates(Points=X, Tolerance=0.1, CullMode=1)  # -> Points, Indices, Valence
I = ClusterOutput(cullpt.Indices)
pdecon = Deconstruct(Point=cullpt.Points)  # -> XComponent, YComponent, ZComponent
X_2 = ClusterOutput(pdecon.XComponent)

# ==== cluster Ensure2Levels
T = ClusterInput()
tstat = TreeStatistics(Tree=T)  # -> Paths, Length, Count
dpath = DeconstructPath(Branch=tstat.Paths)
lng = ListLength(List=dpath)  # -> flatten(Length)
ins = InsertItems(List=dpath, Item="0", Indices="0", Wrap=True)
path = ConstructPath(Indices=ins)  # -> flatten(Branch)
item = ListItem(List=lng, Index=0, Wrap=True)
replace = ReplacePaths(Data=T, Search=tstat.Paths, Replace=path)
pshift = ShiftPaths(Data=replace, Offset=expr("x-1", item))
D = ClusterOutput(pshift)

# ==== cluster DynamicOffset
C = ClusterInput()
explode = Explode(Curve=C, Recursive=True)  # -> Segments, Vertices
item = ListItem(List=explode.Segments, Index="0", Wrap=True)
len = Length(Curve=item)
offset = Slider(0.1, range=0..0.1)
division = Division(A=len, B="2")
addition = Addition(A=division, B=offset)  # -> simplify(Result)
ensure_2_levels = Ensure2Levels(T=addition)
pshift = ShiftPaths(Data=ensure_2_levels, Offset="-1")
D = ClusterOutput(pshift)

# ==== cluster OffsetPathNumbering
tree = ClusterInput()
existing_tree = ClusterInput()
tstat = TreeStatistics(Tree=tree)  # -> Paths, Length, Count
tstat_2 = TreeStatistics(Tree=existing_tree)  # -> Paths, Length, Count
series = Series(Start=0, Step=1, Count=tstat.Count)
addition = Addition(A=series, B=tstat_2.Count)  # -> graft(Result)
path = ConstructPath(Indices=addition)  # -> flatten(Branch)
replace = ReplacePaths(Data=tree, Search=tstat.Paths, Replace=path)
shifted_tree = ClusterOutput(replace)

# ==== cluster LinearInterpolateBetweenPoints
values = ClusterInput()
ranges = ClusterInput()
X = ClusterInput()
consec = ConsecutiveDomains(Numbers=ranges, Additive=False)
consec_2 = ConsecutiveDomains(Numbers=values, Additive=False)
fdom = FindDomain(Domains=consec, Number=X, Strict=False)  # -> Index, Neighbour
item = ListItem(List=consec_2, Index=fdom.Index, Wrap=True)
item_2 = ListItem(List=consec, Index=fdom.Index, Wrap=True)
dedomain = DeconstructDomain(Domain=item)  # -> Start, End
remap = RemapNumbers(Value=X, Source=item_2, Target="0 To 1")  # -> Mapped, Clipped
interp = InterpolateData(Data=[dedomain.Start, dedomain.End], Parameter=remap.Mapped, Interpolation=2)
res = ClusterOutput(interp)
